# Grasshopper definition comfort.gh (Grasshopper 1.0.7)

path = FilePath("F:\SEU\2026\simulation\CHN_Jiangsu.Nanjing.582380_CSWD\CHN_Jiangsu.Nanjing.582380_CSWD.epw")  # disabled

# ----
# 数据输入
brep = Brep([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])
context_data = Surface(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)
massing_data = GetGeometry(brep, AtLeast=1, AtMost=1, DeleteInput=False, Filter=1074004029, TreeAccess=False)
context_data_2 = GetGeometry(context_data, AtLeast=1, AtMost=1, DeleteInput=False, Filter=1074004029, TreeAccess=False)
brep_2 = Brep(massing_data)

# ----
# 空气温度等气象数据可视化
# 风玫瑰图
importepw = LBImportEPW(epw_file=path)  # -> location, dry_bulb_temperature, dew_point_temperature, relative_humidity, wind_speed, wind_direction, direct_normal_rad, diffuse_horizontal_rad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; disabled; plug-in component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

# ---- group: 计算人体辐射温度MRT
number_slider = Slider(2, range=0..10)  # disabled
number_slider_2 = Slider(1.6, range=0..10)  # disabled
boolean_toggle = BooleanToggle(True)  # disabled
point = Point(Point(102, -194.8075489, 0))  # disabled
brep_3 = Brep([<brep referenced from the Rhino model> x4])  # disabled
humantosky = LBHumanToSkyRelation(
    location=importepw.location,
    position=flatten(point),
    context=flatten(brep_3),
    pt_count=number_slider,
    height=number_slider_2,
    run=boolean_toggle)  # -> out, human_points, human_line, fract_body_exp, sky_exposure; disabled; plug-in component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
boolean_toggle_2 = BooleanToggle(True)  # disabled
outdoorsolarmrt = LBOutdoorSolarMRT(
    location=importepw.location,
    surface_temp=importepw.dry_bulb_temperature,
    dir_norm_rad=importepw.direct_normal_rad,
    diff_horiz_rad=importepw.diffuse_horizontal_rad,
    horiz_infrared=importepw.horizontal_infrared_rad,
    fract_body_exp=humantosky.fract_body_exp,
    sky_exposure=humantosky.sky_exposure,
    run=boolean_toggle_2)  # -> out, short_erf, long_erf, short_dmrt, long_dmrt, mrt; disabled; plug-in component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

# ----
# 热舒适模拟
number_slider_3 = Slider(5, range=0..10)
genpts = LBGeneratePointGrid(geometry=context_data_2, grid_size=number_slider_3)  # -> points, vectors, face_areas, mesh; plug-in component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
path_2 = FilePath("F:\SEU\2026\simulation\compute_simulation\CHN_Jiangsu.Nanjing.582380_CSWD\CHN_Jiangsu.Nanjing.582380_CSWD.epw")
importepw_2 = LBImportEPW(epw_file=path_2)  # -> location, dry_bulb_temperature, dew_point_temperature, relative_humidity, wind_speed, wind_direction, direct_normal_rad, diffuse_horizontal_rad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; plug-in component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
humantosky_2 = LBHumanToSkyRelation(
    location=importepw_2.location,
    position=flatten(genpts.points),
    context=flatten(brep_2),
    pt_count=Slider(2, range=0..10),
    height=Slider(1.6, range=0..10),
    run=Toggle(True))  # -> out, human_points, human_line, fract_body_exp, sky_exposure; plug-in component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
analysisperiod = LBAnalysisPeriod(
    start_month=Slider(6, range=0..10),
    start_day=Slider(12, range=0..100),
    start_hour=0,
    end_month=Slider(9, range=0..10),
    end_day=Slider(6, range=0..100))  # -> period, hoys, dates; plug-in component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
applyper = LBApplyAnalysisPeriod(data=importepw_2.wind_speed, period=analysisperiod.period)  # -> data; plug-in component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
applyper_2 = LBApplyAnalysisPeriod(data=importepw_2.direct_normal_rad, period=analysisperiod.period)  # -> data; plug-in component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
applyper_3 = LBApplyAnalysisPeriod(data=importepw_2.horizontal_infrared_rad, period=analysisperiod.period)  # -> data; plug-in component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
applyper_4 = LBApplyAnalysisPeriod(data=importepw_2.relative_humidity, period=analysisperiod.period)  # -> data; plug-in component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
applyper_5 = LBApplyAnalysisPeriod(data=importepw_2.diffuse_horizontal_rad, period=analysisperiod.period)  # -> data; plug-in component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
applyper_6 = LBApplyAnalysisPeriod(data=importepw_2.dry_bulb_temperature, period=analysisperiod.period)  # -> data; plug-in component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
applyper_7 = LBApplyAnalysisPeriod(data=humantosky_2.fract_body_exp, period=analysisperiod.period)  # -> data; plug-in component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
outdoorsolarmrt_2 = LBOutdoorSolarMRT(
    location=importepw_2.location,
    surface_temp=applyper_6,
    dir_norm_rad=applyper_2,
    diff_horiz_rad=applyper_5,
    horiz_infrared=applyper_3,
    fract_body_exp=applyper_7,
    sky_exposure=humantosky_2.sky_exposure,
    run=Toggle(True))  # -> out, short_erf, long_erf, short_dmrt, long_dmrt, mrt; plug-in component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
utci = LBUTCIComfort(air_temp=applyper_6, mrt=outdoorsolarmrt_2.mrt, rel_humid=applyper_4, wind_vel=applyper, run=Toggle(True))  # -> out, utci, comfort, condition, category, comf_obj; plug-in component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

analysisperiod_2 = LBAnalysisPeriod(start_month=1, start_day=1, start_hour=0)  # -> period, hoys, dates; disabled; plug-in component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
applyper_8 = LBApplyAnalysisPeriod(data=importepw.wind_speed, period=analysisperiod_2.period)  # -> data; disabled; plug-in component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
boolean_toggle_3 = BooleanToggle(True)  # disabled
# 每个月的风玫瑰图
utci_2 = LBUTCIComfort(
    air_temp=importepw.dry_bulb_temperature,
    mrt=outdoorsolarmrt.mrt,
    rel_humid=importepw.relative_humidity,
    wind_vel=importepw.wind_speed,
    run=boolean_toggle_3)  # -> out, utci, comfort, condition, category, comf_obj; disabled; plug-in component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
panel = Panel("4")  # disabled
legendpar = LBLegendParameters(text_height=panel)  # -> leg_par; disabled; plug-in component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
comfstat = LBComfortStatistics(comf_obj=flatten(utci_2.comf_obj))  # -> pct_hot, pct_neutral, pct_cold; disabled; plug-in component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
point_2 = Point(Point(6, -241.8636934, 0))  # disabled
panel_2 = Panel(comfstat.pct_neutral)  # disabled

# ----
# 云图可视化
number_slider_4 = Slider(0, range=0..10)
xdata = LBDeconstructData(data=utci.utci)  # -> header, values; plug-in component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
colrange = LBColorRange(index=number_slider_4)  # -> colors; plug-in component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
mass_addition = MassAddition(Input=xdata.values)  # -> Result, PartialResults
legendpar_2 = LBLegendParameters(colors=colrange, text_height="4")  # -> leg_par; plug-in component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
list_length = ListLength(List=xdata.values)
division = Division(A=mass_addition.Result, B=list_length)  # -> simplify(flatten(Result))
heatmap = LBSpatialHeatmap(values=simplify(division), mesh=simplify(genpts.mesh), legend_par=legendpar_2, legend_title="UTCI")  # -> mesh, legend, title, colors, legend_par, vis_set; plug-in component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

hourlyplot = LBHourlyPlot(data=flatten(utci_2.utci), base_pt=point_2, legend_par=legendpar)  # -> report, mesh, legend, borders, labels, title, vis_set; disabled; plug-in component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

# ----
# 图像输出
# 月度图
number_slider_5 = Slider(7211, range=0..10000)
area = Area(Geometry=context_data_2)  # -> Area, Centroid
pt = Point(area.Centroid)
Z = UnitZ(Factor=number_slider_5)
path_3 = FilePath("F:\SEU\2026\simulation\compute_simulation\grasshopper\comfort.png")
move = Move(Geometry=pt, Motion=Z)  # -> Geometry, Transform
panel_3 = Panel(path_3)
c_script = CSharpScript(
    on=Toggle(True),
    CameraLocation=move.Geometry,
    CameraTarget=pt,
    len=Slider(100, range=0..100),
    shoot=Toggle(True),
    file=path_3)  # -> out, A; inputs on: Boolean, CameraLocation: Point3d, CameraTarget: Point3d, len: Double, bias: Double, shoot: Boolean, file: String
# ---------- c_script: C# usings ----------
using System.Drawing;
# ---------- c_script: C# ----------
    Point3d cL = CameraLocation;
    Point3d cT = CameraTarget;
    if(on)
    {
      Rhino.Display.RhinoViewport v = RhinoDoc.ActiveDoc.Views.ActiveView.ActiveViewport;
      Vector3d vec = cT - cL;
      v.SetCameraDirection(vec, true);
      v.Camera35mmLensLength = len;
      v.Rotate(bias / 180 * Math.PI, v.CameraZ, v.CameraLocation);
      Vector3d cz = v.CameraZ;
      A = cz;
      if(shoot)
      {
        Rhino.RhinoDoc.ActiveDoc.Views.ActiveView.CaptureToBitmap(new Size(1920, 1080)).Save(file);
      }
    }
# ---------- end c_script ----------

geo = Geometry([hourlyplot.mesh, hourlyplot.legend, hourlyplot.borders, hourlyplot.labels])  # disabled
