# Grasshopper definition massing.gh (Grasshopper 1.0.7)

# ---- group: Input
# 输入
massing_index = Slider(2, range=0..3)
massing_index_2 = GetInteger(massing_index, AtLeast=1, AtMost=1, Maximum=2147483647, Minimum=-2147483648, TreeAccess=False)

# ----
# 2: 组团式园区
W = Slider(65.5, range=0..100)
h3 = Slider(34.5, range=0..100)
b3w = Slider(25.6, range=0..100)
b3l = Slider(38.7, range=0..100)
court_ratio = Slider(0.3, range=0..1)
b2w = Slider(22.3, range=0..100)
h1 = Slider(24, range=0..100)
h2 = Slider(21.5, range=0..100)
b1w = Slider(33.7, range=0..100)
b2l = Slider(34.6, range=0..100)
b1l = Slider(25.7, range=0..100)
L = Slider(78.5, range=0..100)
angle = Slider(-1.34, range=-30..30)
W_2 = GetNumber(W, AtLeast=1, AtMost=1, Maximum=1.797693135e+308, Minimum=-1.797693135e+308, TreeAccess=False)
b1l_2 = GetNumber(b1l, AtLeast=1, AtMost=1, Maximum=1.797693135e+308, Minimum=-1.797693135e+308, TreeAccess=False)
L_2 = GetNumber(L, AtLeast=1, AtMost=1, Maximum=1.797693135e+308, Minimum=-1.797693135e+308, TreeAccess=False)
b1w_2 = GetNumber(b1w, AtLeast=1, AtMost=1, Maximum=1.797693135e+308, Minimum=-1.797693135e+308, TreeAccess=False)
court_ratio_2 = GetNumber(court_ratio, AtLeast=1, AtMost=1, Maximum=1.797693135e+308, Minimum=-1.797693135e+308, TreeAccess=False)
b2l_2 = GetNumber(b2l, AtLeast=1, AtMost=1, Maximum=1.797693135e+308, Minimum=-1.797693135e+308, TreeAccess=False)
b2w_2 = GetNumber(b2w, AtLeast=1, AtMost=1, Maximum=1.797693135e+308, Minimum=-1.797693135e+308, TreeAccess=False)
h1_2 = GetNumber(h1, AtLeast=1, AtMost=1, Maximum=1.797693135e+308, Minimum=-1.797693135e+308, TreeAccess=False)
h3_2 = GetNumber(h3, AtLeast=1, AtMost=1, Maximum=1.797693135e+308, Minimum=-1.797693135e+308, TreeAccess=False)
h2_2 = GetNumber(h2, AtLeast=1, AtMost=1, Maximum=1.797693135e+308, Minimum=-1.797693135e+308, TreeAccess=False)
angle_2 = GetNumber(angle, AtLeast=1, AtMost=1, Maximum=1.797693135e+308, Minimum=-1.797693135e+308, TreeAccess=False)
b3l_2 = GetNumber(b3l, AtLeast=1, AtMost=1, Maximum=1.797693135e+308, Minimum=-1.797693135e+308, TreeAccess=False)
b3w_2 = GetNumber(b3w, AtLeast=1, AtMost=1, Maximum=1.797693135e+308, Minimum=-1.797693135e+308, TreeAccess=False)
cluster = GhPythonScript(
    index=massing_index_2,
    L=L_2,
    W=W_2,
    court_ratio=court_ratio_2,
    b1L=b1l_2,
    b1W=b1w_2,
    h1=h1_2,
    b2L=b2l_2,
    b2W=b2w_2,
    h2=h2_2,
    b3L=b3l_2,
    b3W=b3w_2,
    h3=h3_2,
    angle=angle_2)  # -> out, a; inputs index: Int32
# ---------- cluster: Python ----------
import Rhino.Geometry as rg
import math

if index == 2:
    x0 = -L/2
    x1 = L/2
    y0 = -W/2
    y1 = W/2
    
    plane = rg.Plane.WorldXY
    rad = math.radians(angle)
    
    # 庭院（右下角）
    court_L = L * court_ratio
    court_W = W * court_ratio
    
    cx0 = x1 - court_L
    cy0 = y0
    cx1 = x1
    cy1 = y0 + court_W
    
    # 三个体块（角点锚定）
    rect1 = rg.Rectangle3d(
        plane,
        rg.Interval(x1 - b1L, x1),     
        rg.Interval(y1 - b1W, y1)      
    )
    
    rect2 = rg.Rectangle3d(
        plane,
        rg.Interval(x0, x0 + b2L),     
        rg.Interval(y0, y0 + b2W)      
    )
    
    rect3 = rg.Rectangle3d(
        plane,
        rg.Interval(x0, x0 + b3L),     
        rg.Interval(y1 - b3W, y1)      
    )
    
    rects = [rect1, rect2, rect3]
    heights = [h1, h2, h3]
    
    breps = []
    footprints = []
    
    # 旋转（围绕各自中心）
    for i in range(3):
        rect = rects[i]
        crv = rect.ToNurbsCurve()
    
        bbox = crv.GetBoundingBox(True)
        center = bbox.Center
    
        xform = rg.Transform.Rotation(rad, center)
        crv.Transform(xform)
    
        footprints.append(crv)
    
        ext = rg.Extrusion.Create(crv, heights[i], True)
        if ext:
            breps.append(ext.ToBrep())
    
    # 庭院
    courtyard = rg.Rectangle3d(
        plane,
        rg.Interval(cx0, cx1),
        rg.Interval(cy0, cy1)
    ).ToNurbsCurve()
    
    site = rg.Rectangle3d(
        plane,
        rg.Interval(x0, x1),
        rg.Interval(y0, y1)
    ).ToNurbsCurve()
    
    a = breps          # 体块
    b = footprints     # 底面
    c = courtyard      # 庭院
    d = site           # 场地
# ---------- end cluster ----------

# ----
# 0: 中心庭院式
L_3 = Slider(93.3, range=0..100)
gap = Slider(29.7, range=0..100)
h = Slider(24.1, range=0..100)
W_3 = Slider(89.2, range=0..100)
d = Slider(15.4, range=0..100)
h_2 = GetNumber(h, AtLeast=1, AtMost=1, Maximum=1.797693135e+308, Minimum=-1.797693135e+308, TreeAccess=False)
L_4 = GetNumber(L_3, AtLeast=1, AtMost=1, Maximum=1.797693135e+308, Minimum=-1.797693135e+308, TreeAccess=False)
gap_2 = GetNumber(gap, AtLeast=1, AtMost=1, Maximum=1.797693135e+308, Minimum=-1.797693135e+308, TreeAccess=False)
W_4 = GetNumber(W_3, AtLeast=1, AtMost=1, Maximum=1.797693135e+308, Minimum=-1.797693135e+308, TreeAccess=False)
d_2 = GetNumber(d, AtLeast=1, AtMost=1, Maximum=1.797693135e+308, Minimum=-1.797693135e+308, TreeAccess=False)
courtyard = GhPythonScript(index=massing_index_2, L=L_4, W=W_4, gap=gap_2, d=d_2, hN=h_2, hS=h_2, hE=h_2, hW=h_2)  # -> out, a; inputs index: Int32
# ---------- courtyard: Python ----------
import Rhino.Geometry as rg

if index == 0:
    plane = rg.Plane.WorldXY
    
    x0 = -L/2
    x1 = L/2
    y0 = -W/2
    y1 = W/2
    
    # 定义四个体块的底面
    north_rect = rg.Rectangle3d(
        plane,
        rg.Interval(x0 + gap, x1 - gap),
        rg.Interval(y1 - d, y1)
    )
    
    south_rect = rg.Rectangle3d(
        plane,
        rg.Interval(x0 + gap, x1 - gap),
        rg.Interval(y0, y0 + d)
    )
    
    east_rect = rg.Rectangle3d(
        plane,
        rg.Interval(x1 - d, x1),
        rg.Interval(y0 + gap, y1 - gap)
    )
    
    west_rect = rg.Rectangle3d(
        plane,
        rg.Interval(x0, x0 + d),
        rg.Interval(y0 + gap, y1 - gap)
    )
    
    def extrude_rect(rect, height):
        crv = rect.ToNurbsCurve()
        ext = rg.Extrusion.Create(crv, height, True)
        if ext:
            return ext.ToBrep()
        return None
    
    breps = []
    
    bN = extrude_rect(north_rect, hN)
    bS = extrude_rect(south_rect, hS)
    bE = extrude_rect(east_rect, hE)
    bW = extrude_rect(west_rect, hW)
    
    if bN: breps.append(bN)
    if bS: breps.append(bS)
    if bE: breps.append(bE)
    if bW: breps.append(bW)
    
    courtyard = rg.Rectangle3d(
        plane,
        rg.Interval(x0 + d, x1 - d),
        rg.Interval(y0 + d, y1 - d)
    ).ToNurbsCurve()
    
    a = breps        # 四个体块
    b = courtyard    # 庭院
    c = [north_rect, south_rect, east_rect, west_rect]  # 底面（调试）
# ---------- end courtyard ----------

# ----
# 3: 基座塔楼式
v_site = Slider(-0.61, range=-1..1.01)
u_site = Slider(-0.32, range=-1..1.01)
tl = Slider(20.6, range=0..100)
tw = Slider(34.2, range=0..100)
u = Slider(0.25, range=-1..1.01)
ph = Slider(16.9, range=0..100)
th = Slider(49.9, range=0..100)
pl = Slider(60.5, range=0..100)
W_5 = Slider(55.5, range=0..100)
pw = Slider(39.8, range=0..100)
L_5 = Slider(75.5, range=0..100)
v = Slider(-0.13, range=-1..1.01)
v_site_2 = GetNumber(v_site, AtLeast=1, AtMost=1, Maximum=1.797693135e+308, Minimum=-1.797693135e+308, TreeAccess=False)
pl_2 = GetNumber(pl, AtLeast=1, AtMost=1, Maximum=1.797693135e+308, Minimum=-1.797693135e+308, TreeAccess=False)
u_site_2 = GetNumber(u_site, AtLeast=1, AtMost=1, Maximum=1.797693135e+308, Minimum=-1.797693135e+308, TreeAccess=False)
u_2 = GetNumber(u, AtLeast=1, AtMost=1, Maximum=1.797693135e+308, Minimum=-1.797693135e+308, TreeAccess=False)
th_2 = GetNumber(th, AtLeast=1, AtMost=1, Maximum=1.797693135e+308, Minimum=-1.797693135e+308, TreeAccess=False)
v_2 = GetNumber(v, AtLeast=1, AtMost=1, Maximum=1.797693135e+308, Minimum=-1.797693135e+308, TreeAccess=False)
W_6 = GetNumber(W_5, AtLeast=1, AtMost=1, Maximum=1.797693135e+308, Minimum=-1.797693135e+308, TreeAccess=False)
tl_2 = GetNumber(tl, AtLeast=1, AtMost=1, Maximum=1.797693135e+308, Minimum=-1.797693135e+308, TreeAccess=False)
tw_2 = GetNumber(tw, AtLeast=1, AtMost=1, Maximum=1.797693135e+308, Minimum=-1.797693135e+308, TreeAccess=False)
pw_2 = GetNumber(pw, AtLeast=1, AtMost=1, Maximum=1.797693135e+308, Minimum=-1.797693135e+308, TreeAccess=False)
ph_2 = GetNumber(ph, AtLeast=1, AtMost=1, Maximum=1.797693135e+308, Minimum=-1.797693135e+308, TreeAccess=False)
L_6 = GetNumber(L_5, AtLeast=1, AtMost=1, Maximum=1.797693135e+308, Minimum=-1.797693135e+308, TreeAccess=False)
tower = GhPythonScript(
    index=massing_index_2,
    L=L_6,
    W=W_6,
    pL=pl_2,
    pW=pw_2,
    pH=ph_2,
    tL=tl_2,
    tW=tw_2,
    tH=th_2,
    u_site=u_site_2,
    v_site=v_site_2,
    u=u_2,
    v=v_2)  # -> out, a; inputs index: Int32
# ---------- tower: Python ----------
import Rhino.Geometry as rg

if index == 3:
    if L <= 0 or W <= 0:
        a = None
        b = None
        c = None
    else:
        plane = rg.Plane.WorldXY
    
        # 场地基准点
        # u_site, v_site ∈ [-1, 1]
        bx = u_site * (L / 2)
        by = v_site * (W / 2)
    
        base_pt = rg.Point3d(bx, by, 0)
    
        # 创建基座
        base_plane = rg.Plane(base_pt, rg.Vector3d.ZAxis)
    
        podium_rect = rg.Rectangle3d(
            base_plane,
            rg.Interval(-pL/2, pL/2),
            rg.Interval(-pW/2, pW/2)
        )
    
        podium_crv = podium_rect.ToNurbsCurve()
    
        podium_ext = rg.Extrusion.Create(podium_crv, pH, True)
        podium_brep = podium_ext.ToBrep() if podium_ext else None
    
        # 塔楼位置
        max_x = (pL - tL) / 2
        max_y = (pW - tW) / 2
    
        tx = base_pt.X + u * max_x
        ty = base_pt.Y + v * max_y
    
        tower_center = rg.Point3d(tx, ty, pH)
    
        tower_plane = rg.Plane(tower_center, rg.Vector3d.ZAxis)
    
        tower_rect = rg.Rectangle3d(
            tower_plane,
            rg.Interval(-tL/2, tL/2),
            rg.Interval(-tW/2, tW/2)
        )
    
        tower_crv = tower_rect.ToNurbsCurve()
    
        tower_ext = rg.Extrusion.Create(tower_crv, tH, True)
        tower_brep = tower_ext.ToBrep() if tower_ext else None
    
        site = rg.Rectangle3d(
            plane,
            rg.Interval(-L/2, L/2),
            rg.Interval(-W/2, W/2)
        ).ToNurbsCurve()
    
        a = [podium_brep, tower_brep]
        b = [podium_crv, tower_crv]
        c = site
        d = base_pt
# ---------- end tower ----------

# ----
# 1: 线性创新园区式
H = Slider(25.9, range=0..100)
W_7 = Slider(55.6, range=0..100)
bl = Slider(25.5, range=0..100)
n = Slider(3, range=0..10)
L_7 = Slider(75.5, range=0..100)
bw = Slider(82.4, range=0..100)
spacing = Slider(30.8, range=0..100)
angle_3 = Slider(0, range=0..100)
angle_4 = GetNumber(angle_3, AtLeast=1, AtMost=1, Maximum=1.797693135e+308, Minimum=-1.797693135e+308, TreeAccess=False)
bw_2 = GetNumber(bw, AtLeast=1, AtMost=1, Maximum=1.797693135e+308, Minimum=-1.797693135e+308, TreeAccess=False)
H_2 = GetNumber(H, AtLeast=1, AtMost=1, Maximum=1.797693135e+308, Minimum=-1.797693135e+308, TreeAccess=False)
spacing_2 = GetNumber(spacing, AtLeast=1, AtMost=1, Maximum=1.797693135e+308, Minimum=-1.797693135e+308, TreeAccess=False)
bl_2 = GetNumber(bl, AtLeast=1, AtMost=1, Maximum=1.797693135e+308, Minimum=-1.797693135e+308, TreeAccess=False)
n_2 = GetNumber(n, AtLeast=1, AtMost=1, Maximum=1.797693135e+308, Minimum=-1.797693135e+308, TreeAccess=False)
L_8 = GetNumber(L_7, AtLeast=1, AtMost=1, Maximum=1.797693135e+308, Minimum=-1.797693135e+308, TreeAccess=False)
W_8 = GetNumber(W_7, AtLeast=1, AtMost=1, Maximum=1.797693135e+308, Minimum=-1.797693135e+308, TreeAccess=False)
array = GhPythonScript(index=massing_index_2, L=L_8, W=W_8, n=n_2, spacing=spacing_2, bL=bl_2, bW=bw_2, H=H_2, angle=angle_4)  # -> out, a; inputs index: Int32, n: Int32
# ---------- array: Python ----------
import Rhino.Geometry as rg
import math

if index == 1:
    if n < 1:
        a = []
        b = None
        c = None
    else:
        plane = rg.Plane.WorldXY
    
        # 阵列总长度（用于居中）
        total_length = n * bL + (n - 1) * spacing
        start_x = -total_length / 2 + bL / 2
        rad = math.radians(angle)
        
        breps = []
        footprints = []
    
        for i in range(n):
    
            # 体块中心
            x = start_x + i * (bL + spacing)
            center = rg.Point3d(x, 0, 0)
    
            # 局部平面（用于旋转）
            local_plane = rg.Plane(center, rg.Vector3d.ZAxis)
            local_plane.Rotate(rad, rg.Vector3d.ZAxis)
    
            rect = rg.Rectangle3d(
                local_plane,
                rg.Interval(-bL/2, bL/2),
                rg.Interval(-bW/2, bW/2)
            )
    
            crv = rect.ToNurbsCurve()
            footprints.append(crv)
    
            ext = rg.Extrusion.Create(crv, H, True)
            if ext:
                breps.append(ext.ToBrep())
    
        site = rg.Rectangle3d(
            plane,
            rg.Interval(-L/2, L/2),
            rg.Interval(-W/2, W/2)
        ).ToNurbsCurve()
    
        a = breps        # 体块
        b = footprints   # 底面
        c = site         # 场地
# ---------- end array ----------

# ----
# 输出
merge = Merge(Data1=flatten(courtyard.a), Data2=flatten(array.a), Data3=flatten(cluster.a), Data4=flatten(tower.a))
null = NullItem(Item=merge)  # -> NullFlags, InvalidFlags, Description
dispatch = Dispatch(List=merge, DispatchPattern=null.NullFlags)  # -> ListA, ListB
geo = Geometry(dispatch.ListB)
context_bake = ContextBake(Geometry=geo)
