# Grasshopper definition sunlight_bake.gh (Grasshopper 1.0.7)

geo = Geometry([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])
geo_2 = Geometry([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])
file_path = FilePath("F:\SEU\2026\simulation\compute_simulation\CHN_Jiangsu.Nanjing.582380_CSWD\CHN_Jiangsu.Nanjing.582380_CSWD.epw")
context_data = GetGeometry(geo, AtLeast=1, AtMost=1, DeleteInput=False, Filter=1074004029, TreeAccess=False)
massing_data = GetGeometry(geo_2, AtLeast=1, AtMost=1, DeleteInput=False, Filter=1074004029, TreeAccess=False)
importepw = LBImportEPW(epw_file=file_path)  # -> location, dry_bulb_temperature, dew_point_temperature, relative_humidity, wind_speed, wind_direction, direct_normal_rad, diffuse_horizontal_rad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; plug-in component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
geo_3 = Geometry(context_data)
geo_4 = Geometry(massing_data)
number_slider = Slider(22, range=0..100)
number_slider_2 = Slider(12, range=0..100)
analysisperiod = LBAnalysisPeriod(
    start_month=number_slider_2,
    start_day=number_slider,
    start_hour=0,
    end_month=number_slider_2,
    end_day=number_slider,
    timestep=Slider(12, range=0..100))  # -> period, hoys, dates; plug-in component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
srf = Surface(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)
area = Area(Geometry=srf)  # -> Area, Centroid
sunpath = LBSunPath(location=importepw.location, hoys=analysisperiod.hoys, center_pt=area.Centroid, scale=Slider(10, range=0..100))  # -> out, vectors, altitudes, azimuths, hoys, sun_pts, analemma, daily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; plug-in component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
merge = Merge(Data1=ColourSwatch(SwatchColor=RGB(40, 0, 158)), Data2=ColourSwatch(SwatchColor=RGB(194, 0, 0)))
legendpar = LBLegendParameters(
    min=Slider(0, range=0..100),
    max=Slider(8, range=0..10),
    seg_count=Slider(17, range=0..100),
    num_decimals=Slider(1, range=0..1))  # -> leg_par; plug-in component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
value = GetNumber(Slider(0, range=0..1), AtLeast=1, AtMost=1, Maximum=1.797693135e+308, Minimum=-1.797693135e+308, TreeAccess=False)
pt = Point(area.Centroid)
Z = UnitZ(Factor=Slider(7091, range=0..10000))
path = FilePath("F:\SEU\2026\simulation\compute_simulation\grasshopper\sunlight.png")
move = Move(Geometry=pt, Motion=Z)  # -> Geometry, Transform
larger = LargerThan(FirstNumber=value, SecondNumber="0")  # -> LargerThan, OrEqualTo
directsunhours = LBDirectSunHours(
    vectors=flatten(sunpath.vectors),
    timestep=Slider(12, range=0..100),
    geometry=flatten(geo_4),
    context=flatten(geo_3),
    grid_size=Slider(3.5, range=0..10),
    offset_dist=Slider(0.1, range=0..1),
    legend_par=legendpar,
    run=Toggle(True))  # -> out, points, results, mesh, legend, title, int_mtx; plug-in component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
panel = Panel(path)
c_script = CSharpScript(
    on=larger.LargerThan,
    CameraLocation=move.Geometry,
    CameraTarget=pt,
    len=Slider(100, range=0..100),
    shoot=larger.LargerThan,
    file=path)  # -> out, A; inputs on: Boolean, CameraLocation: Point3d, CameraTarget: Point3d, len: Double, bias: Double, shoot: Boolean, file: String
# ---------- c_script: C# usings ----------
using System.Drawing;
# ---------- c_script: C# ----------
    Point3d cL = CameraLocation;
    Point3d cT = CameraTarget;
    if(on)
    {
      Rhino.Display.RhinoViewport v = RhinoDoc.ActiveDoc.Views.ActiveView.ActiveViewport;
      Vector3d vec = cT - cL;
      v.SetCameraDirection(vec, true);
      v.Camera35mmLensLength = len;
      v.Rotate(bias / 180 * Math.PI, v.CameraZ, v.CameraLocation);
      Vector3d cz = v.CameraZ;
      A = cz;
      if(shoot)
      {
        Rhino.RhinoDoc.ActiveDoc.Views.ActiveView.CaptureToBitmap(new Size(1920, 1080)).Save(file);
      }
    }
# ---------- end c_script ----------
context_print = ContextPrint(Result=c_script.A)
