# Grasshopper definition wind.gh (Grasshopper 1.0.7)
# plug-ins: Eddy3D

templates = Templates()
epwmap = LBEPWmap(epw_map=Toggle(False))  # -> Output; plug-in component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

# ----
# 数据输入
srf = Surface(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)
brep = Brep(flatten([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]))
context_data = GetGeometry(srf, AtLeast=1, AtMost=1, DeleteInput=False, Filter=1074004029, TreeAccess=False)
massing_data = GetGeometry(brep, AtLeast=1, AtMost=1, DeleteInput=False, Filter=1074004029, TreeAccess=False)
srf_2 = Surface(context_data)
mesh = Mesh(massing_data)
mjoin = MeshJoin(Meshes=mesh)

# ----
# 风环境模拟及可视化
number_slider = Slider(3, range=0..10)
abl = ABL(WDir=Slider(45, range=0..100), Uref=number_slider, Zref=10, Z0=1, ZGround=0)
domainbox = BoxShapedDomain(Geometry=mjoin, BoundaryCondition=abl, BlockSize=20)  # -> Domain, Mesh
panel = Panel("C:\3_SimpleWindAnalysiss")
mset = MeshSettings(AccBuilding=2, AccFeatures="3", AccBBox=0, AccGround="3", MiscSettings=1, NumberOfLayers=4, Mode=2)
rset = RunSettings(
    NumberOfIterations=Slider(60, range=0..100),
    WriteInterval=20,
    NumberOfTimestepsToKeep=3,
    TurbulenceModel=1,
    RelaxationFactors=3,
    SolutionAndAlgorithmControl=1,
    PotentialFoamInitialization=False,
    AgeOfAir=False,
    NumberOfCPUs="-1",
    OperatingSystem=0)
button = Button()
simulation = Simulation(
    SimulationDomain=domainbox.Domain,
    WorkingDirectory=panel,
    MeshSettings=mset,
    RunSettings=rset,
    RunMeshing=button,
    MakeTrees=False,
    RunSimulation=button,
    runWithBlueCFD=True)
genpts = LBGeneratePointGrid(geometry=srf_2, grid_size=Slider(2, range=0..10))  # -> points, vectors, face_areas, mesh; plug-in component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
visprobes = VisualizeProbes(Result=simulation, ProbingPoints=genpts.points, NameOfInstance="ttt", NameOfField=0, Run=Button())  # -> PorbingPoints, ProbingResult
clean = Clean(Directory=panel, Mode=2, Run=Button())
points = Data(visprobes.PorbingPoints)
vectors = Data(visprobes.ProbingResult)
sort = SortList(Keys=vectors)  # -> Keys, ValuesA
larger = LargerThan(FirstNumber=vectors, SecondNumber=Slider(15, range=0..15))  # -> LargerThan, OrEqualTo
paraview = Paraview(Result=simulation, ParaviewVersion=2, Run=Button())
dispatch = Dispatch(List=vectors, DispatchPattern=larger.LargerThan)  # -> ListA, ListB
index = ItemIndex(List=vectors, Item=dispatch.ListA)
replace = ReplaceItems(List=vectors, Item=Slider(15, range=0..15), Indices=index, Wrap=False)
data = Data(replace)
bnd = Bounds(Numbers=data)
dedomain = DeconstructDomain(Domain=bnd)  # -> Start, End
gradient = Gradient(
    LowerLimit=dedomain.Start,
    UpperLimit=dedomain.End,
    Parameter=data,
    stops=[0: RGB(0, 255, 106), 0.103: RGB(0, 0, 255), 0.22: RGB(0, 170, 255), 0.305: RGB(0, 255, 255), 0.398: RGB(0, 255, 188), 0.605: RGB(91, 255, 0), 0.699: RGB(184, 255, 0), 0.799: RGB(255, 255, 0), 0.898: RGB(255, 170, 0)])
heatmap = LBSpatialHeatmap(values=replace, mesh=genpts.mesh, legend_title="m/s", global_title="风速")  # -> mesh, legend, title, colors, legend_par, vis_set; plug-in component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
geo = Geometry(heatmap.legend)
geo_2 = Geometry(heatmap.mesh)
vdisex = VectorDisplayEx(Point=points, Vector=vectors, Colour=gradient, Width=Slider(1, range=0..10))

# ----
# EPW文件地址
# https://energyplus-weather.s3.amazonaws.com/asia_wmo_region_2/CHN/CHN_Shanghai.Shanghai.583670_IWEC/CHN_Shanghai.Shanghai.583670_IWEC.zip
number_slider_2 = Slider(3, range=0..10)  # disabled
# 风速风向
number_slider_3 = Slider(45, range=0..100)  # disabled
brep_2 = Brep(flatten([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]))  # disabled
massing_data_2 = GetGeometry(brep_2, AtLeast=1, AtMost=1, DeleteInput=False, Filter=1074004029, TreeAccess=False)  # disabled
mesh_2 = Mesh(massing_data_2)  # disabled
abl_2 = ABL(WDir=number_slider_3, Uref=number_slider_2, Zref=10, Z0=1, ZGround=0)  # disabled
mjoin_2 = MeshJoin(Meshes=mesh_2)  # disabled
domainbox_2 = BoxShapedDomain(Geometry=mjoin_2, BoundaryCondition=abl_2, BlockSize=20)  # -> Domain, Mesh; disabled
panel_2 = Panel("C:\3_SimpleWindAnalysiss")  # disabled
number_slider_4 = Slider(60, range=0..100)  # disabled
button_2 = Button()  # disabled
panel_3 = Panel("-1")  # disabled
panel_4 = Panel("3")  # disabled

# ----
# 图像输出
number_slider_5 = Slider(8460, range=0..10000)
area = Area(Geometry=srf_2)  # -> Area, Centroid
pt = Point(area.Centroid)
Z = UnitZ(Factor=number_slider_5)
path = FilePath("F:\SEU\2026\simulation\compute_simulation\grasshopper\wind.png")
move = Move(Geometry=pt, Motion=Z)  # -> Geometry, Transform
panel_5 = Panel(path)
c_script = CSharpScript(
    on=Toggle(True),
    CameraLocation=move.Geometry,
    CameraTarget=pt,
    len=Slider(91, range=0..100),
    shoot=Toggle(True),
    file=path)  # -> out, A; inputs on: Boolean, CameraLocation: Point3d, CameraTarget: Point3d, len: Double, bias: Double, shoot: Boolean, file: String
# ---------- c_script: C# usings ----------
using System.Drawing;
# ---------- c_script: C# ----------
    Point3d cL = CameraLocation;
    Point3d cT = CameraTarget;
    if(on)
    {
      Rhino.Display.RhinoViewport v = RhinoDoc.ActiveDoc.Views.ActiveView.ActiveViewport;
      Vector3d vec = cT - cL;
      v.SetCameraDirection(vec, true);
      v.Camera35mmLensLength = len;
      v.Rotate(bias / 180 * Math.PI, v.CameraZ, v.CameraLocation);
      Vector3d cz = v.CameraZ;
      A = cz;
      if(shoot)
      {
        Rhino.RhinoDoc.ActiveDoc.Views.ActiveView.CaptureToBitmap(new Size(1920, 1080)).Save(file);
      }
    }
# ---------- end c_script ----------

button_3 = Button()  # disabled
mset_2 = MeshSettings(AccBuilding=2, AccFeatures=panel_4, AccBBox=0, AccGround=panel_4, MiscSettings=1, NumberOfLayers=4, Mode=2)  # disabled
rset_2 = RunSettings(
    NumberOfIterations=number_slider_4,
    WriteInterval=20,
    NumberOfTimestepsToKeep=3,
    TurbulenceModel=1,
    RelaxationFactors=3,
    SolutionAndAlgorithmControl=1,
    PotentialFoamInitialization=False,
    AgeOfAir=False,
    NumberOfCPUs=panel_3,
    OperatingSystem=0)  # disabled
simulation_2 = Simulation(
    SimulationDomain=domainbox_2.Domain,
    WorkingDirectory=panel_2,
    MeshSettings=mset_2,
    RunSettings=rset_2,
    RunMeshing=button_3,
    MakeTrees=False,
    RunSimulation=button_3,
    runWithBlueCFD=True)  # disabled
residuals = Residuals(Result=simulation_2, X=":", Y=":", Version=1, Run=button_2, visResiduals=True)  # disabled
number_slider_6 = Slider(2, range=0..10)  # disabled
# 分析面
srf_3 = Surface(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)  # disabled
genpts_2 = LBGeneratePointGrid(geometry=srf_3, grid_size=number_slider_6)  # -> points, vectors, face_areas, mesh; disabled; plug-in component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
panel_6 = Panel("ttt")  # disabled
button_4 = Button()  # disabled
visprobes_2 = VisualizeProbes(Result=simulation_2, ProbingPoints=genpts_2.points, NameOfInstance=panel_6, NameOfField=0, Run=button_4)  # -> PorbingPoints, ProbingResult; disabled
# Clean
# 此处为数值筛选 大于2.2米每秒 替换为2.3等 按实际结果替换
button_5 = Button()  # disabled
number_slider_7 = Slider(15, range=0..15)  # disabled
points_2 = Data(visprobes_2.PorbingPoints)  # disabled
vectors_2 = Data(visprobes_2.ProbingResult)  # disabled
# Paraview
button_6 = Button()  # disabled
clean_2 = Clean(Directory=panel_2, Mode=2, Run=button_5)  # disabled
paraview_2 = Paraview(Result=simulation_2, ParaviewVersion=2, Run=button_6)  # disabled
sort_2 = SortList(Keys=vectors_2)  # -> Keys, ValuesA; disabled
panel_7 = Panel(vectors_2)  # disabled
larger_2 = LargerThan(FirstNumber=vectors_2, SecondNumber=number_slider_7)  # -> LargerThan, OrEqualTo; disabled
panel_8 = Panel(sort_2.Keys)  # disabled
number_slider_8 = Slider(1, range=0..10)  # disabled
dispatch_2 = Dispatch(List=vectors_2, DispatchPattern=larger_2.LargerThan)  # -> ListA, ListB; disabled
number_slider_9 = Slider(15, range=0..15)  # disabled
index_2 = ItemIndex(List=vectors_2, Item=dispatch_2.ListA)  # disabled
number_slider_10 = Slider(8460, range=0..10000)  # disabled
replace_2 = ReplaceItems(List=vectors_2, Item=number_slider_9, Indices=index_2, Wrap=False)  # disabled
data_2 = Data(replace_2)  # disabled
bnd_2 = Bounds(Numbers=data_2)  # disabled
dedomain_2 = DeconstructDomain(Domain=bnd_2)  # -> Start, End; disabled
gradient_2 = Gradient(
    LowerLimit=dedomain_2.Start,
    UpperLimit=dedomain_2.End,
    Parameter=data_2,
    stops=[0.103: RGB(0, 0, 255), 0.22: RGB(0, 170, 255), 0.305: RGB(0, 255, 255), 0.398: RGB(0, 255, 188), 0.504: RGB(0, 255, 106), 0.605: RGB(91, 255, 0), 0.699: RGB(184, 255, 0), 0.799: RGB(255, 255, 0), 0.898: RGB(255, 170, 0)])  # disabled
# 风向
vdisex_2 = VectorDisplayEx(Point=points_2, Vector=vectors_2, Colour=gradient_2, Width=number_slider_8)  # disabled
area_2 = Area(Geometry=srf_3)  # -> Area, Centroid; disabled
panel_9 = Panel("风速")  # disabled
panel_10 = Panel("m/s")  # disabled
panel_11 = Panel(replace_2)  # disabled
heatmap_2 = LBSpatialHeatmap(values=replace_2, mesh=genpts_2.mesh, legend_title=panel_10, global_title=panel_9)  # -> mesh, legend, title, colors, legend_par, vis_set; disabled; plug-in component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
pt_2 = Point(area_2.Centroid)  # disabled
number_slider_11 = Slider(91, range=0..100)  # disabled
Z_2 = UnitZ(Factor=number_slider_10)  # disabled
toggle = BooleanToggle(True)  # disabled
path_2 = FilePath("F:\SEU\2026\simulation\compute_simulation\grasshopper\wind.png")  # disabled
move_2 = Move(Geometry=pt_2, Motion=Z_2)  # -> Geometry, Transform; disabled
toggle_2 = BooleanToggle(True)  # disabled
geo_3 = Geometry(heatmap_2.mesh)  # disabled
geo_4 = Geometry(heatmap_2.legend)  # disabled
panel_12 = Panel(path_2)  # disabled
c_script_2 = CSharpScript(on=toggle_2, CameraLocation=move_2.Geometry, CameraTarget=pt_2, len=number_slider_11, shoot=toggle, file=path_2)  # -> out, A; inputs on: Boolean, CameraLocation: Point3d, CameraTarget: Point3d, len: Double, bias: Double, shoot: Boolean, file: String; disabled; same code as c_script
