# Grasshopper definition 数据交互.gh (Grasshopper 1.0.7)

窗线 = Curve(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)
飘窗线 = Curve([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])
最大矩形 = Curve(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)
门线 = Curve(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)

baywindows = GetGeometry(飘窗线, AtLeast=1, AtMost=1, DeleteInput=False, Filter=1074004029, TreeAccess=False)
window = GetGeometry(窗线, AtLeast=1, AtMost=1, DeleteInput=False, Filter=1074004029, TreeAccess=False)
door = GetGeometry(门线, AtLeast=1, AtMost=1, DeleteInput=False, Filter=1074004029, TreeAccess=False)
rectangle = GetGeometry(最大矩形, AtLeast=1, AtMost=1, DeleteInput=False, Filter=1074004029, TreeAccess=False)
cluster = Cluster_9(飘窗线=baywindows, 窗线=window, 最大矩形=rectangle, 门线=door)  # -> geo_12, geo_10, geo_11, geo_13, geo_15, geo_14
mesh_join = MeshJoin(Meshes=[cluster.geo_12, cluster.geo_10, cluster.geo_11, cluster.geo_13, cluster.geo_15, cluster.geo_14])
context_bake = ContextBake(OutputMesh=mesh_join)
panel = Panel(mesh_join)
explode_tree = ExplodeTree()  # -> Branch0, Branch1, Branch2, Branch3, Branch4

# ---- group: 打标签
panel_2 = Panel("SideBoard")
panel_3 = Panel("TOP")
swatch = ColourSwatch(SwatchColor=RGB(219, 198, 164))
panel_4 = Panel("SideBoard")
panel_5 = Panel("DOORb")
swatch_2 = ColourSwatch(SwatchColor=RGB(161, 139, 106))
swatch_3 = ColourSwatch(SwatchColor=RGB(255, 255, 255))
cluster_2 = Cluster_2(T=swatch)  # -> flatten(R)
cluster_3 = Cluster_2(T=swatch_2)  # -> flatten(R)
swatch_4 = ColourSwatch(SwatchColor=RGB(161, 139, 106))
panel_6 = Panel("SideBoard")
panel_7 = Panel("BODYb")
cluster_4 = Cluster_2(T=swatch_3)  # -> flatten(R)
swatch_5 = ColourSwatch(SwatchColor=RGB(235, 235, 235))
cluster_5 = Cluster_2(T=swatch_4)  # -> flatten(R)
cluster_6 = Cluster_2(T=swatch_5)  # -> flatten(R)
merge = Merge(Data1="N", Data2="N", Data3="SideBoard", Data4="DOORa", Data5=cluster_4)
merge_2 = Merge(Data1="N", Data2="N", Data3="SideBoard", Data4="BODYa", Data5=cluster_6)
cluster_7 = Cluster(T=merge)
cluster_8 = Cluster(T=merge_2)
c_script = CSharpScript(x=flatten(explode_tree.Branch2), name=cluster_7)  # -> out, flatten(A); inputs name: String, plane: String, rotate: String, tag: String; same code as c_script_13
c_script_2 = CSharpScript(x=flatten(explode_tree.Branch0), name=cluster_8)  # -> out, flatten(A); inputs name: String, plane: String, rotate: String, tag: String; same code as c_script_13
custom_preview = CustomPreview(Geometry=c_script.A, Material=swatch_3)
custom_preview_2 = CustomPreview(Geometry=c_script_2.A, Material=swatch_5)

# ----
merge_3 = Merge(Data1="N", Data2="N", Data3=panel_2, Data4=panel_3, Data5=cluster_2)
merge_4 = Merge(Data1="N", Data2="N", Data3=panel_4, Data4=panel_5, Data5=cluster_3)
merge_5 = Merge(Data1="N", Data2="N", Data3=panel_6, Data4=panel_7, Data5=cluster_5)

# ---- group: 打标签 (continued)
cluster_9 = Cluster(T=merge_3)
cluster_10 = Cluster(T=merge_4)
cluster_11 = Cluster(T=merge_5)
c_script_3 = CSharpScript(x=flatten(explode_tree.Branch4), name=cluster_9)  # -> out, flatten(A); inputs name: String, plane: String, rotate: String, tag: String; same code as c_script_13
c_script_4 = CSharpScript(x=flatten(explode_tree.Branch3), name=cluster_10)  # -> out, flatten(A); inputs name: String, plane: String, rotate: String, tag: String; same code as c_script_13
c_script_5 = CSharpScript(x=flatten(explode_tree.Branch1), name=cluster_11)  # -> out, flatten(A); inputs name: String, plane: String, rotate: String, tag: String; same code as c_script_13
custom_preview_3 = CustomPreview(Geometry=c_script_3.A, Material=swatch)
custom_preview_4 = CustomPreview(Geometry=c_script_4.A, Material=swatch_2)
custom_preview_5 = CustomPreview(Geometry=c_script_5.A, Material=swatch_4)

# ----
merge_6 = Merge(Data1=c_script_2.A, Data2=c_script_5.A, Data3=c_script.A, Data4=c_script_4.A, Data5=c_script_3.A)
panel_8 = Panel(cluster_10)
餐边柜 = Geometry(merge_6)

# ==== cluster Cluster
T = ClusterInput()
join = TextJoin(Text=T, Join="_")
R = ClusterOutput(join)

# ==== cluster Cluster_2
T = ClusterInput()
split = TextSplit(Text=T, Separators=",")
item = ListItem(List=split, Index=0, Wrap=True)  # -> Item, Item1, Item2
c_script = CSharpScript(x=item.Item, y=item.Item1, z=item.Item2)  # -> out, A; inputs x: Int32, y: Int32, z: Int32
# ---------- c_script: C# ----------
    A = RGBToHex(x, y, z);
# ---------- c_script: C# additional code ----------
  public static string RGBToHex(int red, int green, int blue)
  {
    // 使用格式字符串将 RGB 值转换为 16 进制颜色代码
    return string.Format("#{0:X2}{1:X2}{2:X2}", red, green, blue);
  }
# ---------- end c_script ----------
concat = Concatenate(FragmentA=c_script.A, FragmentB="!")
R = ClusterOutput(concat)

# ==== cluster Cluster_9
飘窗线 = ClusterInput()
窗线 = ClusterInput()
最大矩形 = ClusterInput()
门线 = ClusterInput()

# ----
# 0墙线、1门线、2窗线、3其他凹槽、4最大矩形、5飘窗线
cluster = Cluster_3(飘窗线=飘窗线, 窗线=窗线, 最大矩形=最大矩形, 门线=门线)  # -> 窗线_6, 最大矩形_3, 墙线_2, 门线_3, 飘窗线_3, 房间轮廓_3
entwine = Entwine(
    Branch00=cluster.墙线_2,
    Branch01=cluster.门线_3,
    Branch02=cluster.窗线_6,
    Branch04=cluster.最大矩形_3,
    Branch05=cluster.飘窗线_3,
    FlattenInputs=True)
bang = ExplodeTree(Data=entwine)  # -> Branch0, Branch1, Branch2, Branch3, Branch4, Branch5

cluster_2 = Cluster_8(
    最大矩形=bang.Branch4,
    relay_2=bang.Branch5,
    wincrv=bang.Branch2,
    其他凹槽=bang.Branch3,
    最大矩形_2=bang.Branch4,
    墙线=bang.Branch0,
    门线=bang.Branch1,
    relay=bang.Branch2,
    最大矩形_3=bang.Branch4,
    最大矩形_4=bang.Branch4,
    最大矩形_5=bang.Branch4,
    最大矩形_6=bang.Branch4,
    最大矩形_7=bang.Branch4,
    最大矩形_8=bang.Branch4,
    最大矩形_9=bang.Branch4)  # -> 凹槽书柜_2, 飘窗台_2, 书柜_2, 衣柜_2, 榻榻米_2, 边柜_2, 书桌线, 书桌_2, 吊柜_2, 椅子_2
geo = Geometry(cluster_2.边柜_2)
geo_2 = Geometry(cluster_2.衣柜_2)
geo_3 = Geometry(cluster_2.榻榻米_2)
geo_4 = Geometry(cluster_2.书柜_2)
geo_5 = Geometry(cluster_2.凹槽书柜_2)
geo_6 = Geometry(cluster_2.飘窗台_2)
geo_7 = Geometry(cluster_2.书桌_2)
geo_8 = Geometry(cluster_2.椅子_2)
geo_9 = Geometry(cluster_2.吊柜_2)
geo_10 = ClusterOutput(geo_2)
geo_11 = ClusterOutput(geo_3)
geo_12 = ClusterOutput(geo_6)
geo_13 = ClusterOutput(geo_7)
geo_14 = ClusterOutput(geo_8)
geo_15 = ClusterOutput(geo_9)

# ==== cluster Cluster_3
飘窗线 = ClusterInput()
房间轮廓 = ClusterInput()
飘窗线_2 = Curve(飘窗线)
房间轮廓_2 = Curve(房间轮廓)
最大矩形 = ClusterInput()
门线 = ClusterInput()
飘窗线_3 = ClusterOutput(飘窗线_2)
窗线 = ClusterInput()
房间轮廓_3 = ClusterOutput(房间轮廓_2)
窗线_2 = Curve(窗线)

# ---- group: 解析窗线和飘窗轮廓线
# x:飘窗线
python = GhPythonScript(x=飘窗线_2)  # -> out, b, a; inputs x: list of Curve
# ---------- python: Python ----------
if(len(x) is 0):
    b = True
else:
    b = False
    x.sort(key=lambda c : c.GetLength())
    
    a = x
# ---------- end python ----------
item = ListItem(List=python.a, Index=0, Wrap=True)  # -> Item, Item1
飘窗外轮廓 = Curve(item.Item1)
窗线_3 = Curve(item.Item)
filter = StreamFilter(Gate=python.b, Stream0=窗线_3, Stream1=窗线_2)
窗线_4 = Curve(filter)

# ----
最大矩形_2 = Curve(最大矩形)
门线_2 = Curve(门线)
窗线_5 = Curve(窗线_4)
解析墙线 = 解析墙线(A=最大矩形_2, d1=门线_2, d2=窗线_5)
墙线 = Curve(解析墙线)

最大矩形_3 = ClusterOutput(最大矩形_2)
门线_3 = ClusterOutput(门线_2)
墙线_2 = ClusterOutput(墙线)
窗线_6 = ClusterOutput(窗线_4)

# ==== cluster Cluster_8
relay = ClusterInput()
最大矩形 = ClusterInput()
wincrv = ClusterInput()
其他凹槽 = ClusterInput()
最大矩形_2 = ClusterInput()
墙线 = ClusterInput()
门线 = ClusterInput()
最大矩形_3 = ClusterInput()
最大矩形_4 = ClusterInput()
最大矩形_5 = ClusterInput()
最大矩形_6 = ClusterInput()
最大矩形_7 = ClusterInput()
最大矩形_8 = ClusterInput()
最大矩形_9 = ClusterInput()
relay_2 = ClusterInput()
多功能房_书房茶室收纳 = 多功能房书房茶室收纳(
    最大矩形=最大矩形,
    relay=relay_2,
    wincrv=wincrv,
    其他凹槽=其他凹槽,
    最大矩形_5=最大矩形_2,
    墙线=墙线,
    门线=门线,
    relay_2=relay,
    最大矩形_7=最大矩形_3,
    最大矩形_9=最大矩形_4,
    最大矩形_10=最大矩形_5,
    最大矩形_3=最大矩形_6,
    最大矩形_8=最大矩形_7,
    最大矩形_4=最大矩形_8,
    最大矩形_6=最大矩形_9)  # -> 凹槽书柜_2, 飘窗台_2, 书柜_3, 衣柜体, 衣柜门, 榻榻米_3, 榻榻米底柜_3, 榻榻米边柜体_2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
书桌线 = ClusterOutput(多功能房_书房茶室收纳.书桌线_4)
geo = Geometry(多功能房_书房茶室收纳.榻榻米_3)
geo_2 = Geometry(多功能房_书房茶室收纳.衣柜门)
geo_3 = Geometry(多功能房_书房茶室收纳.榻榻米边柜门_2)
geo_4 = Geometry(多功能房_书房茶室收纳.榻榻米边柜体_2)
geo_5 = Geometry(多功能房_书房茶室收纳.榻榻米底柜_3)
geo_6 = Geometry(多功能房_书房茶室收纳.书柜_3)
geo_7 = Geometry(多功能房_书房茶室收纳.书桌)
geo_8 = Geometry(多功能房_书房茶室收纳.凹槽书柜_2)
geo_9 = Geometry(多功能房_书房茶室收纳.衣柜体)
geo_10 = Geometry(多功能房_书房茶室收纳.椅子_2)
geo_11 = Geometry(多功能房_书房茶室收纳.书桌抽屉)
geo_12 = Geometry(多功能房_书房茶室收纳.吊柜_2)
geo_13 = Geometry(多功能房_书房茶室收纳.吊柜)
geo_14 = Geometry(多功能房_书房茶室收纳.飘窗台_2)

swatch = ColourSwatch(SwatchColor=RGB(209, 197, 171))
cluster = Cluster_2(T=swatch)  # -> flatten(R)
merge = Merge(Data1="office", Data2="N", Data3="WallBoard", Data4="BODY", Data5=cluster)
cluster_2 = Cluster(T=merge)
c_script = CSharpScript(x=flatten(geo_12), name=cluster_2)  # -> out, flatten(A); inputs name: String, plane: String, rotate: String, tag: String; same code as c_script_13
custom_preview = CustomPreview(Geometry=c_script.A, Material=swatch)

swatch_2 = ColourSwatch(SwatchColor=RGB(209, 197, 171))
cluster_3 = Cluster_2(T=swatch_2)  # -> flatten(R)
merge_2 = Merge(Data1="office", Data2="N", Data3="SideBoard", Data4="BODY", Data5=cluster_3)
cluster_4 = Cluster(T=merge_2)
c_script_2 = CSharpScript(x=flatten(geo_4), name=cluster_4)  # -> out, flatten(A); inputs name: String, plane: String, rotate: String, tag: String; same code as c_script_13
custom_preview_2 = CustomPreview(Geometry=c_script_2.A, Material=swatch_2)

swatch_3 = ColourSwatch(SwatchColor=RGB(189, 189, 189))
cluster_5 = Cluster_2(T=swatch_3)  # -> flatten(R)
merge_3 = Merge(Data1="office", Data2="N", Data3="WallBoard", Data4="DOOR", Data5=cluster_5)
cluster_6 = Cluster(T=merge_3)
c_script_3 = CSharpScript(x=flatten(geo_13), name=cluster_6)  # -> out, flatten(A); inputs name: String, plane: String, rotate: String, tag: String; same code as c_script_13
custom_preview_3 = CustomPreview(Geometry=c_script_3.A, Material=swatch_3)

swatch_4 = ColourSwatch(SwatchColor=RGB(209, 197, 171))
cluster_7 = Cluster_2(T=swatch_4)  # -> flatten(R)
merge_4 = Merge(Data1="office", Data2="N", Data3="Closet", Data4="BODY", Data5=cluster_7)
cluster_8 = Cluster(T=merge_4)
c_script_4 = CSharpScript(x=flatten(geo_9), name=cluster_8)  # -> out, flatten(A); inputs name: String, plane: String, rotate: String, tag: String; same code as c_script_13
custom_preview_4 = CustomPreview(Geometry=c_script_4.A, Material=swatch_4)

swatch_5 = ColourSwatch(SwatchColor=RGB(189, 189, 189))
cluster_9 = Cluster_2(T=swatch_5)  # -> flatten(R)
merge_5 = Merge(Data1="office", Data2="N", Data3="Closet", Data4="DOOR", Data5=cluster_9)
cluster_10 = Cluster(T=merge_5)
c_script_5 = CSharpScript(x=flatten(geo_2), name=cluster_10)  # -> out, flatten(A); inputs name: String, plane: String, rotate: String, tag: String; same code as c_script_13
custom_preview_5 = CustomPreview(Geometry=c_script_5.A, Material=swatch_5)

swatch_6 = ColourSwatch(SwatchColor=RGB(209, 197, 171))
cluster_11 = Cluster_2(T=swatch_6)  # -> flatten(R)
merge_6 = Merge(Data1="office", Data2="N", Data3="Tatami", Data4="BODY", Data5=cluster_11)
cluster_12 = Cluster(T=merge_6)
c_script_6 = CSharpScript(x=flatten(geo), name=cluster_12)  # -> out, flatten(A); inputs name: String, plane: String, rotate: String, tag: String; same code as c_script_13
custom_preview_6 = CustomPreview(Geometry=c_script_6.A, Material=swatch_6)

swatch_7 = ColourSwatch(SwatchColor=RGB(207, 195, 169))
cluster_13 = Cluster_2(T=swatch_7)  # -> flatten(R)
merge_7 = Merge(Data1="office", Data2="N", Data3="Bookshelf", Data4="BODY", Data5=cluster_13)
cluster_14 = Cluster(T=merge_7)
c_script_7 = CSharpScript(x=flatten(geo_6), name=cluster_14)  # -> out, flatten(A); inputs name: String, plane: String, rotate: String, tag: String; same code as c_script_13
custom_preview_7 = CustomPreview(Geometry=c_script_7.A, Material=swatch_7)
书柜 = Geometry(c_script_7.A)

swatch_8 = ColourSwatch(SwatchColor=RGB(189, 189, 189))
cluster_15 = Cluster_2(T=swatch_8)  # -> flatten(R)
merge_8 = Merge(Data1="office", Data2="N", Data3="SideBoard", Data4="DOOR", Data5=cluster_15)
cluster_16 = Cluster(T=merge_8)
c_script_8 = CSharpScript(x=flatten(geo_3), name=cluster_16)  # -> out, flatten(A); inputs name: String, plane: String, rotate: String, tag: String; same code as c_script_13
custom_preview_8 = CustomPreview(Geometry=c_script_8.A, Material=swatch_8)

swatch_9 = ColourSwatch(SwatchColor=RGB(189, 189, 189))
cluster_17 = Cluster_2(T=swatch_9)  # -> flatten(R)
merge_9 = Merge(Data1="office", Data2="N", Data3="Desk", Data4="DOOR", Data5=cluster_17)
cluster_18 = Cluster(T=merge_9)
c_script_9 = CSharpScript(x=flatten(geo_11), name=cluster_18)  # -> out, flatten(A); inputs name: String, plane: String, rotate: String, tag: String; same code as c_script_13
custom_preview_9 = CustomPreview(Geometry=c_script_9.A, Material=swatch_9)

swatch_10 = ColourSwatch(SwatchColor=RGB(189, 189, 189))
cluster_19 = Cluster_2(T=swatch_10)  # -> flatten(R)
merge_10 = Merge(Data1="office", Data2="N", Data3="Tatami", Data4="DOOR", Data5=cluster_19)
cluster_20 = Cluster(T=merge_10)
c_script_10 = CSharpScript(x=flatten(geo_5), name=cluster_20)  # -> out, flatten(A); inputs name: String, plane: String, rotate: String, tag: String; same code as c_script_13
custom_preview_10 = CustomPreview(Geometry=c_script_10.A, Material=swatch_10)

swatch_11 = ColourSwatch(SwatchColor=RGB(209, 197, 171))
cluster_21 = Cluster_2(T=swatch_11)  # -> flatten(R)
merge_11 = Merge(Data1="office", Data2="N", Data3="Desk", Data4="BODY", Data5=cluster_21)
cluster_22 = Cluster(T=merge_11)
c_script_11 = CSharpScript(x=flatten(geo_7), name=cluster_22)  # -> out, flatten(A); inputs name: String, plane: String, rotate: String, tag: String; same code as c_script_13
custom_preview_11 = CustomPreview(Geometry=c_script_11.A, Material=swatch_11)

swatch_12 = ColourSwatch(SwatchColor=RGB(217, 201, 167))
cluster_23 = Cluster_2(T=swatch_12)  # -> flatten(R)
merge_12 = Merge(Data1="office", Data2="N", Data3="Bookshelf", Data4="BODY", Data5=cluster_23)
cluster_24 = Cluster(T=merge_12)
c_script_12 = CSharpScript(x=flatten(geo_8), name=cluster_24)  # -> out, flatten(A); inputs name: String, plane: String, rotate: String, tag: String; same code as c_script_13
custom_preview_12 = CustomPreview(Geometry=c_script_12.A, Material=swatch_12)
凹槽书柜 = Geometry(c_script_12.A)

swatch_13 = ColourSwatch(SwatchColor=RGB(201, 201, 201))
cluster_25 = Cluster_2(T=swatch_13)  # -> flatten(R)
merge_13 = Merge(Data1="office", Data2="N", Data3="BayWindow", Data4="BODY", Data5=cluster_25)
cluster_26 = Cluster(T=merge_13)
c_script_13 = CSharpScript(x=flatten(geo_14), name=cluster_26)  # -> out, flatten(A); inputs name: String, plane: String, rotate: String, tag: String; same code as c_script_13
custom_preview_13 = CustomPreview(Geometry=c_script_13.A, Material=swatch_13)
飘窗台 = Geometry(c_script_13.A)

merge_14 = Merge(Data1=c_script_2.A, Data2=c_script_8.A)
边柜 = Geometry(merge_14)

merge_15 = Merge(Data1=c_script_4.A, Data2=c_script_5.A)
衣柜 = Geometry(merge_15)

merge_16 = Merge(Data1=c_script_6.A, Data2=c_script_10.A)
榻榻米 = Geometry(merge_16)

merge_17 = Merge(Data1=c_script.A, Data2=c_script_3.A)
吊柜 = Geometry(merge_17)

merge_18 = Merge(Data1=c_script_11.A, Data2=c_script_9.A)
书桌 = Geometry(merge_18)

椅子 = Geometry(geo_10)
榻榻米_2 = ClusterOutput(榻榻米)
书柜_2 = ClusterOutput(书柜)
椅子_2 = ClusterOutput(椅子)
衣柜_2 = ClusterOutput(衣柜)
飘窗台_2 = ClusterOutput(飘窗台)
边柜_2 = ClusterOutput(边柜)
吊柜_2 = ClusterOutput(吊柜)
书桌_2 = ClusterOutput(书桌)
凹槽书柜_2 = ClusterOutput(凹槽书柜)

# ==== cluster 解析墙线
d1 = ClusterInput()
d2 = ClusterInput()
merge = Merge(Data1=d1, Data2=d2)  # -> flatten(Result)
A = ClusterInput()
ccx = CurveCurve(CurveA=A, CurveB=merge)  # -> Points, flatten(ParamsA), ParamsB
shatter = Shatter(Curve=A, Parameters=ccx.ParamsA)
python = GhPythonScript(x=shatter, y=merge)  # -> out, a; inputs x: list of Curve, y: list of Curve
# ---------- python: Python ----------
import math


list1 = [round(c.GetLength(),2) for c in y]
a = []
for crv in x:
    if(round(crv.GetLength(),2) not in list1):
        a.append(crv)
# ---------- end python ----------
a = ClusterOutput(python.a)

# ==== cluster 多功能房书房茶室收纳
墙线 = ClusterInput()
门线 = ClusterInput()
explode = Explode(Curve=墙线, Recursive=True)  # -> flatten(Segments), Vertices

# ---- group: 筛选出与targetCrv同边的线
c_script = CSharpScript(curves=explode.Segments, targetCrv=门线)  # -> out, A, B; inputs curves: list of Curve, targetCrv: Curve
# ---------- c_script: C# usings ----------
using rd = Rhino.NodeInCode;
# ---------- c_script: C# ----------
    var cntCrvs = new List<Curve>();
    var uncntCrvs = FilterCrv(targetCrv, curves, out cntCrvs);

    A = uncntCrvs;
    B = cntCrvs;
# ---------- c_script: C# additional code ----------
  /// <summary>
  /// 根据目标曲线，从曲线列表中筛选出和目标曲线不平行相交的线段
  /// </summary>
  /// <param name="targetCrv">目标曲线，如门线，窗线</param>
  /// <param name="curves">墙线</param>
  ///<param name="connectedCurves">和目标曲线相邻的线</param>
  /// <returns></returns>
  public List<Curve> FilterCrv(Curve targetCrv, List<Curve> curves, out List<Curve> connectedCurves)
  {
    List<Curve> unconnectedCurves = new List<Curve>();
    connectedCurves = new List<Curve>();
    var sPt = targetCrv.PointAtStart;
    var ePt = targetCrv.PointAtEnd;
    foreach(var crv in curves)
    {
      if(IsTwoCrvCnt(crv, targetCrv))
      {
        var vec1 = crv.TangentAtStart;
        var vec2 = targetCrv.TangentAtStart;
        if(Vector3d.Multiply(vec1, vec2) != 0)
        {
          connectedCurves.Add(crv);
        }
      }else
      {
        unconnectedCurves.Add(crv);
      }
    }
    return unconnectedCurves;
  }

  public bool IsTwoCrvCnt(Curve crv1, Curve crv2)
  {
    var sPt = crv1.PointAtStart;
    var ePt = crv1.PointAtEnd;
    var ssPt = crv2.PointAtStart;
    var eePt = crv2.PointAtEnd;
    if(IsTwoPtSame(sPt, ssPt) || IsTwoPtSame(sPt, eePt) || IsTwoPtSame(ePt, ssPt) || IsTwoPtSame(ePt, eePt))
    {
      return true;
    }
    else{
      return false;
    }
  }

  public bool IsTwoPtSame(Point3d pt1, Point3d pt2)
  {

    if(pt1.DistanceTo(pt2) < 0.001)
    {
      return true;
    }else
    {
      return false;
    }

  }
# ---------- end c_script ----------

# ----
relay = ClusterInput()
门所在墙线 = Curve(c_script.B)
门不同边的墙线 = Curve(c_script.A)

# ---- group: 生成飘窗台 / 前面给的飘窗线包含飘窗轮廓及窗线，对其排序
python = GhPythonScript(x=relay)  # -> out, a; inputs x: list of Curve
# ---------- python: Python ----------
x.sort(key=lambda c : c.GetLength())

a = x
# ---------- end python ----------

# ---- group: 筛选出开门靠墙线
c_script_2 = CSharpScript(doorCrv=门线, unsideCrvs=门不同边的墙线, sideCrvs=门所在墙线)  # -> out, A, B; inputs doorCrv: Curve, unsideCrvs: list of Curve, sideCrvs: list of Curve
# ---------- c_script_2: C# usings ----------
using System.Linq;
# ---------- c_script_2: C# ----------
  
    Curve shortestCrv;
    if(sideCrvs.Count == 1)
    {
      shortestCrv = doorCrv;
    }
    else
    {
      shortestCrv = sideCrvs.OrderBy(x => x.GetLength()).ToList()[0];
    }
    
    var ret = GetCntCrv(shortestCrv, unsideCrvs);
    unsideCrvs.Remove(ret);
    
    A = ret;
    B = unsideCrvs;
# ---------- c_script_2: C# additional code ----------
 
  public Curve GetCntCrv(Curve testCrv,List<Curve> crvs)
  {
    var sPt = testCrv.PointAtStart;
    var ePt = testCrv.PointAtEnd;
    foreach(var crv in crvs)
    {
      if(crv.PointAtStart.CompareTo(sPt) == 0 || crv.PointAtEnd.CompareTo(sPt) == 0 || crv.PointAtStart.CompareTo(ePt) == 0 || crv.PointAtEnd.CompareTo(ePt) == 0)
      {
        return crv;
      }
    }
    return null;
  }
# ---------- end c_script_2 ----------

# ----
c_script_3 = CSharpScript(crvs=门所在墙线)  # -> out, A; inputs crvs: list of Curve
# ---------- c_script_3: C# ----------
    if(crvs.Count == 1)
    {
      A = crvs[0];
    }
    else
    {
      A = crvs.OrderBy(x => x.GetLength()).ToList()[1];
    }
# ---------- end c_script_3 ----------
relay_2 = ClusterInput()
最大矩形 = ClusterInput()

# ---- group: 生成飘窗台
item = ListItem(List=python.a, Index=0, Wrap=True)  # -> Item, Item1
窗线 = Curve(item.Item)
外轮廓 = Curve(item.Item1)
最大矩形_2 = Curve(最大矩形)
python_2 = GhPythonScript(x=relay)  # -> out, a; inputs x: tree of Curve
# ---------- python_2: Python ----------
if(x is not None):
    a = True
else:
    a = False
# ---------- end python_2 ----------
join = JoinCurves(Curves=[窗线, 外轮廓], Preserve=False)
指向内部向量 = 指向内部向量(C_2=最大矩形_2, C=窗线)
srf = Surface(join)
rev = Reverse(Vector=指向内部向量)
墙厚 = Panel("0.06")
飘窗台厚度 = Panel("0.01")
amp = Amplitude(Vector=rev, Amplitude=墙厚)
Z = UnitZ(Factor=飘窗台厚度)
move = Move(Geometry=窗线, Motion=amp)  # -> Geometry, Transform
窗台高度 = Panel("0.75")
loft = Loft(
    Curves=flatten([窗线, move.Geometry]),
    Options={Adjust=False, Closed=False, LoftEnds=0, LoftSimp=0, LoftType=0, Rebuild=10, Refit=0.01})
Z_2 = UnitZ(Factor=窗台高度)
move_2 = Move(Geometry=srf, Motion=Z_2)  # -> Geometry, Transform
extr = Extrude(Base=move_2.Geometry, Direction=Z)
extr_2 = Extrude(Base=loft, Direction=Z_2)
mesh = MeshBrep(
    Brep=[extr_2, extr],
    Settings={GridMaxCount=0, GridMinCount=16, JaggedSeams=False, MaxEdgeLength=0, MinEdgeLength=0.0001, MinTolerance=0, Refine=True, RefineAngle=0, RelativeTolerance=0.65, SimplePlanes=True, Tolerance=0})  # -> flatten(Mesh)
mjoin = MeshJoin(Meshes=mesh)
filter = StreamFilter(Gate=python_2.a, Stream1=mjoin)
飘窗台 = Mesh(filter)

# ----
开门靠墙边的线 = Curve(c_script_2.A)
剩余墙线 = Curve(c_script_2.B)

# ---- group: 筛选出窗线与最后一面墙线
c_script_4 = CSharpScript(curves=门不同边的墙线, targetCrv=relay_2)  # -> out, A, B; inputs curves: list of Curve, targetCrv: Curve
# ---------- c_script_4: C# ----------
    var cntCrvs = new List<Curve>();
    var uncntCrvs = FilterCrv(targetCrv, curves, out cntCrvs);

    A = uncntCrvs;
    B = cntCrvs;
# ---------- c_script_4: C# additional code ----------
  /// <summary>
  /// 根据目标曲线，从曲线列表中筛选出和目标曲线不平行相交的线段
  /// </summary>
  /// <param name="targetCrv">目标曲线，如门线，窗线</param>
  /// <param name="curves">墙线</param>
  ///<param name="connectedCurves">和目标曲线相邻的线</param>
  /// <returns></returns>
  public List<Curve> FilterCrv(Curve targetCrv, List<Curve> curves, out List<Curve> connectedCurves)
  {
    List<Curve> unconnectedCurves = new List<Curve>();
    connectedCurves = new List<Curve>();
    var sPt = targetCrv.PointAtStart;
    var ePt = targetCrv.PointAtEnd;
    foreach(var crv in curves)
    {
      if(IsTwoCrvCnt(crv, targetCrv))
      {
        var vec1 = crv.TangentAtStart;
        var vec2 = targetCrv.TangentAtStart;

        if(Math.Abs(Vector3d.VectorAngle(vec1, vec2) - Math.PI * 0.5) < 0.001)
        {
          unconnectedCurves.Add(crv);
        }else
        {
          connectedCurves.Add(crv);
        }
      }else
      {
        unconnectedCurves.Add(crv);
      }
    }
    return unconnectedCurves;
  }

  public bool IsTwoCrvCnt(Curve crv1, Curve crv2)
  {
    var sPt = crv1.PointAtStart;
    var ePt = crv1.PointAtEnd;
    var ssPt = crv2.PointAtStart;
    var eePt = crv2.PointAtEnd;
    if(IsTwoPtSame(sPt, ssPt) || IsTwoPtSame(sPt, eePt) || IsTwoPtSame(ePt, ssPt) || IsTwoPtSame(ePt, eePt))
    {
      return true;
    }
    else{
      return false;
    }
  }

  public bool IsTwoPtSame(Point3d pt1, Point3d pt2)
  {

    if(pt1.DistanceTo(pt2) < 0.001)
    {
      return true;
    }else
    {
      return false;
    }

  }
# ---------- end c_script_4 ----------

# ----
其他凹槽 = ClusterInput()
最后一面墙线 = Curve(c_script_4.A)
窗所在墙线 = Curve(c_script_4.B)

# ---- group: 筛选出不邻凹槽的窗户墙线
c_script_5 = CSharpScript(groove=其他凹槽, crvs=窗所在墙线)  # -> out, A; inputs groove: Curve, crvs: list of Curve
# ---------- c_script_5: C# ----------
    if(groove == null)
    {
      A = crvs;
    }
    else
    {
      List<Curve> curves = new List<Curve>();
      foreach(var crv in crvs)
      {
        if(!IsSameDirCntCrv(crv, groove))
        {
          curves.Add(crv);
        }
      }
      A = curves;
    }
# ---------- c_script_5: C# additional code ----------
  public Vector3d GetGrooveDir(Curve curve)
  {
    // 开口两端点连接向量
    var sPt = curve.PointAtStart;
    var ePt = curve.PointAtEnd;

    Vector3d vec = sPt - ePt;
    return vec;
  }

  public bool IsSameDirCntCrv(Curve crv, Curve groove)
  {
    var sPt = groove.PointAtStart;
    var ePt = groove.PointAtEnd;
    var ssPt = crv.PointAtStart;
    var eePt = crv.PointAtEnd;
    var dir = GetGrooveDir(groove);
    var vec = crv.TangentAtStart;
    if(Vector3d.Multiply(dir, vec) == 0)
    {
      if(sPt.CompareTo(ssPt) == 0 || sPt.CompareTo(eePt) == 0 || ePt.CompareTo(ssPt) == 0 || ePt.CompareTo(eePt) == 0)
      {
        return true;
      }
      else{
        return false;
      }
    }
    else{
      return false;
    }
  }
# ---------- end c_script_5 ----------

# ---- group: 检查线是否与凹槽线同向相邻
c_script_6 = CSharpScript(groove=其他凹槽, crv=c_script_3.A)  # -> out, A; inputs groove: Curve, crv: Curve
# ---------- c_script_6: C# ----------
    var result = false;
    if(groove != null)
    {
      result = IsSameDirCntCrv(crv, groove);
    }
    
    A = result;
# ---------- c_script_6: C# additional code ----------
  public Vector3d GetGrooveDir(Curve curve)
  {
    // 开口两端点连接向量
    var sPt = curve.PointAtStart;
    var ePt = curve.PointAtEnd;

    Vector3d vec = sPt - ePt;
    return vec;
  }

  public bool IsSameDirCntCrv(Curve crv, Curve groove)
  {
    var sPt = groove.PointAtStart;
    var ePt = groove.PointAtEnd;
    var ssPt = crv.PointAtStart;
    var eePt = crv.PointAtEnd;
    var dir = GetGrooveDir(groove);
    var vec = crv.TangentAtStart;
    if(Vector3d.Multiply(dir, vec) == 0)
    {
      if(sPt.CompareTo(ssPt) == 0 || sPt.CompareTo(eePt) == 0 || ePt.CompareTo(ssPt) == 0 || ePt.CompareTo(eePt) == 0)
      {
        return true;
      }
      else{
        return false;
      }
    }
    else{
      return false;
    }
  }
# ---------- end c_script_6 ----------

# ----
不邻凹槽的窗户墙线 = Curve(c_script_5.A)
wincrv = ClusterInput()

# ---- group: 检查门与窗是否平行
python_3 = GhPythonScript(dorCrv=门线, winCrv=wincrv)  # -> out, a; inputs dorCrv: Curve, winCrv: Curve
# ---------- python_3: Python ----------
vec1 = dorCrv.TangentAtStart
vec2 = winCrv.TangentAtStart

if(abs(vec1 * vec2) < 0.001):
    a = False
else:
    a = True
# ---------- end python_3 ----------

# ---- group: 窗户位于门侧边
# 情况1
# 情况2
explode_2 = Explode(Curve=explode.Segments, Recursive=True)  # -> flatten(Segments), Vertices
c_script_7 = CSharpScript(winCrvs=不邻凹槽的窗户墙线, crvs=explode_2.Segments)  # -> out, simplify(A); inputs winCrvs: list of Curve, crvs: list of Curve
# ---------- c_script_7: C# ----------
    List<Curve> result = new List<Curve>();
    foreach(var winCrv in winCrvs)
    {
      foreach(var crv in crvs)
      {
        if(crv.GetLength() == winCrv.GetLength())
        {
          continue;
        }
        if(IsTwoCrvCnt(winCrv, crv))
        {
          result.Add(crv);
        }
      }
    }

    A = result;
# ---------- c_script_7: C# additional code ----------
  public bool IsTwoCrvCnt(Curve crv1, Curve crv2)
  {
    var sPt = crv1.PointAtStart;
    var ePt = crv1.PointAtEnd;
    var ssPt = crv2.PointAtStart;
    var eePt = crv2.PointAtEnd;
    if(sPt.CompareTo(ssPt) == 0 || sPt.CompareTo(eePt) == 0 || ePt.CompareTo(ssPt) == 0 || ePt.CompareTo(eePt) == 0)
    {
      return true;
    }
    else{
      return false;
    }
  }
# ---------- end c_script_7 ----------

# ---- group: 窗户位于门对边 / 筛选出与窗户墙线相邻的墙线
c_script_8 = CSharpScript(winCrvs=不邻凹槽的窗户墙线, crvs=门不同边的墙线)  # -> out, simplify(A); inputs winCrvs: list of Curve, crvs: list of Curve; same code as c_script_7

# ---- group: 窗所在边线
merge = Merge(Data1=flatten(窗所在墙线), Data2=flatten(relay_2))
join_2 = JoinCurves(Curves=merge, Preserve=False)
窗所在边线 = Curve(join_2)

# ----
filter_2 = StreamFilter(Gate=python_3.a, Stream0=c_script_7.A, Stream1=c_script_8.A)

与窗户墙线相邻墙线 = Curve(filter_2)

# ---- group: 无凹槽或凹槽不位于开门背墙
# 情况1
开门靠墙线 = Curve(开门靠墙边的线)
c_script_9 = CSharpScript(winCrvs=与窗户墙线相邻墙线, dcrv=开门靠墙线)  # -> out, A, B, idx; inputs winCrvs: list of Curve, dcrv: Curve
# ---------- c_script_9: C# ----------
    int index = 0;
    Curve crv = null;
    Curve crv2 = null;
    if(winCrvs.Count == 1)
    {
      crv = winCrvs[0];
      crv2 = winCrvs[0];
      idx = index;
    }else
    {
      for(int i = 0; i < winCrvs.Count; i++)
      {
        if(IsTwoCrvCnt(winCrvs[i], dcrv))
        {
          crv = winCrvs[i];
          crv2 = winCrvs[(i + 1) % winCrvs.Count];
          break;
        }
        index += 1;
      }
    }
      A = crv;
      B = crv2;
      idx = index;
# ---------- c_script_9: C# additional code ----------
    public bool IsTwoCrvCnt(Curve crv1, Curve crv2)
  {
    var sPt = crv1.PointAtStart;
    var ePt = crv1.PointAtEnd;
    var ssPt = crv2.PointAtStart;
    var eePt = crv2.PointAtEnd;
    if(IsTwoPtSame(sPt, ssPt) || IsTwoPtSame(sPt, eePt) || IsTwoPtSame(ePt, ssPt) || IsTwoPtSame(ePt, eePt))
    {
      return true;
    }
    else{
      return false;
    }
  }

  public bool IsTwoPtSame(Point3d pt1, Point3d pt2)
  {

    if(pt1.DistanceTo(pt2) < 0.001)
    {
      return true;
    }else
    {
      return false;
    }

  }
# ---------- end c_script_9 ----------
item_2 = ListItem(窗所在墙线=窗所在墙线, Index=c_script_9.idx, Wrap=True)  # -> Item, Item1
merge_2 = Merge(Data1=c_script_9.A, Data2=item_2.Item, Data3=c_script_9.B, Data4=item_2.Item1)  # -> flatten(Result)

# ---- group: 凹槽位于开门背墙
# 情况2
c_script_10 = CSharpScript(winCrvs=窗所在墙线, wallCrvs=与窗户墙线相邻墙线)  # -> out, A, B, C, D; inputs winCrvs: list of Curve, wallCrvs: list of Curve
# ---------- c_script_10: C# ----------
    var sortedWallCrvs = wallCrvs.OrderBy(x => x.GetLength()).ToList();

    A = sortedWallCrvs[0];
    C = sortedWallCrvs[1];

    foreach(var winCrv in winCrvs)
    {
      if(IsTwoCrvCnt(sortedWallCrvs[0], winCrv))
      {
        B = winCrv;
      }else if(IsTwoCrvCnt(sortedWallCrvs[1], winCrv))
      {
        D = winCrv;
      }
    }
# ---------- c_script_10: C# additional code ----------
  public bool IsTwoCrvCnt(Curve crv1, Curve crv2)
  {
    var sPt = crv1.PointAtStart;
    var ePt = crv1.PointAtEnd;
    var ssPt = crv2.PointAtStart;
    var eePt = crv2.PointAtEnd;
    if(sPt.CompareTo(ssPt) == 0 || sPt.CompareTo(eePt) == 0 || ePt.CompareTo(ssPt) == 0 || ePt.CompareTo(eePt) == 0)
    {
      return true;
    }
    else{
      return false;
    }
  }
# ---------- end c_script_10 ----------
merge_3 = Merge(Data1=c_script_10.A, Data2=c_script_10.B, Data3=c_script_10.C, Data4=c_script_10.D)

# ---- group: 生成书柜
房间高度 = Panel("2.5")
单柜高度 = Panel("0.35")
c_script_11 = CSharpScript(groove=其他凹槽)  # -> out, A; inputs groove: Curve; same code as c_script
cluster = Cluster_4(凹槽线=其他凹槽, A=房间高度, F=单柜高度)
mjoin_2 = MeshJoin(Meshes=cluster)
filter_3 = StreamFilter(Gate=c_script_11.A, Stream1=mjoin_2)
凹槽书柜 = Mesh(filter_3)

# ---- group: 判断开门靠墙有无凹槽
判断两侧墙有无凹槽 = GhPythonScript(groove=其他凹槽, crvs=与窗户墙线相邻墙线, x=开门靠墙线)  # -> out, a; inputs groove: Curve, crvs: list of Curve, x: Curve
# ---------- 判断两侧墙有无凹槽: Python ----------
length = max([crv.GetLength() for crv in crvs])
if(groove == None):
    a = False
elif(x == None):
    a = True
elif(x.GetLength() < length):
    a = True
else:
    a = False
# ---------- end 判断两侧墙有无凹槽 ----------

# ----
filter_4 = StreamFilter(Gate=判断两侧墙有无凹槽.a, Stream0=merge_2, Stream1=merge_3)

item_3 = ListItem(List=flatten(filter_4), Index=0, Wrap=True)  # -> Item, Item1, Item2, Item3

# ---- group: 开门靠背
墙线_2 = Curve(item_3.Item)
窗墙线 = Curve(item_3.Item1)

# ---- group: 另一侧
窗墙线_2 = Curve(item_3.Item3)
墙线_3 = Curve(item_3.Item2)

# ---- group: 判断门与窗是否平行
merge_4 = Merge(Data1=墙线_2, Data2=墙线_3)
rev_2 = ReverseList(List=merge_4)
filter_5 = StreamFilter(Gate=python_3.a, Stream0=rev_2, Stream1=merge_4)
item_4 = ListItem(List=filter_5, Index=0, Wrap=True)  # -> Item, Item1

# ----
最大矩形_3 = ClusterInput()
最大矩形_4 = ClusterInput()
最大矩形_5 = ClusterInput()
最大矩形_6 = ClusterInput()
最大矩形_7 = ClusterInput()

# ---- group: 生成书柜 / y:门窗是否平行
python_4 = GhPythonScript(x=c_script_6.A, y=python_3.a)  # -> out, a
# ---------- python_4: Python ----------
if(not y):
    a = True
else:
    a = x
# ---------- end python_4 ----------

# ----
最大矩形_8 = ClusterInput()

# ---- group: 生成书柜 / 若窗户靠墙，不生成书柜
python_5 = GhPythonScript(x=与窗户墙线相邻墙线)  # -> out, a; inputs x: list
# ---------- python_5: Python ----------
#窗户所在边只有一条墙线，不生成书柜

if(len(x) == 1):
    a = False
else:
    a = True
# ---------- end python_5 ----------

# ----
最大矩形_9 = ClusterInput()
最大矩形_10 = ClusterInput()

# ---- group: 窗墙边是否只有一条
python_6 = GhPythonScript(x=与窗户墙线相邻墙线)  # -> out, a; inputs x: list; same code as python_5

# ----
飘窗台_2 = ClusterOutput(飘窗台)
凹槽书柜_2 = ClusterOutput(凹槽书柜)

# ---- group: 生成书桌
判断是否有凹槽且凹槽是否与门同侧 = 判断是否有凹槽且凹槽是否与门同侧(relay=其他凹槽, 门线=门线)
书桌宽度 = Slider(0.4, range=0..0.8)
抽屉高度 = Panel("0.15")
书桌高度 = Slider(0.67, range=0..1)
最大矩形_11 = Curve(最大矩形_3)
panel = Panel("0.96")

# ----
c_script_12 = CSharpScript(winCrv=窗所在边线, dorBackCrv=开门靠墙边的线)  # -> out, A; inputs winCrv: Curve, dorBackCrv: Curve
# ---------- c_script_12: C# ----------
    if(IsTwoCrvCnt(winCrv,dorBackCrv))
    {
      A = true;
    }
    else
    {
      A = false;
    }
# ---------- c_script_12: C# additional code ----------
  public bool IsTwoCrvCnt(Curve crv1, Curve crv2)
  {
    var sPt = crv1.PointAtStart;
    var ePt = crv1.PointAtEnd;
    var ssPt = crv2.PointAtStart;
    var eePt = crv2.PointAtEnd;
    if(sPt.CompareTo(ssPt) == 0 || sPt.CompareTo(eePt) == 0 || ePt.CompareTo(ssPt) == 0 || ePt.CompareTo(eePt) == 0)
    {
      return true;
    }
    else{
      return false;
    }
  }
# ---------- end c_script_12 ----------
merge_5 = Merge(Data1=item_4.Item, Data2=item_4.Item1)
rev_3 = ReverseList(List=merge_5)

# ---- group: 判断窗是否位于开门靠墙侧
python_7 = GhPythonScript(x=python_3.a, y=c_script_12.A)  # -> out, a; inputs x: Boolean, y: Boolean
# ---------- python_7: Python ----------
if(not x and y):
    a = True
else:
    a = False
# ---------- end python_7 ----------

# ----
filter_6 = StreamFilter(Gate=python_7.a, Stream0=merge_5, Stream1=rev_3)
item_5 = ListItem(List=filter_6, Index=0, Wrap=True)  # -> Item, Item1

# ---- group: 生成书桌 (continued)
crv = Curve(item_5.Item1)
subcrv = SubCurve(BaseCurve=reparameterize(crv), Domain=Slider(0.8, range=0..1))
filter_7 = StreamFilter(Gate=判断是否有凹槽且凹槽是否与门同侧, Stream0=crv, Stream1=subcrv)

# ---- group: 房间面宽小，书桌缩放
# 房间面宽过小，取消榻榻米边书桌
矫正曲线_方向指向门线 = 矫正曲线方向指向门线(crv=filter_7, dorcrv=门线)  # -> s_0, vec_2

# ----
flip = FlipCurve(Curve=矫正曲线_方向指向门线.s_0)  # -> Curve, Flag
vec = Vector(flip.Curve)
merge_6 = Merge(Data1=flip.Curve, Data2=vec)

# ----
# 窗是否位于开门靠墙侧
merge_7 = Merge(Data1=矫正曲线_方向指向门线.s_0, Data2=矫正曲线_方向指向门线.vec_2)
filter_8 = StreamFilter(Gate=python_7.a, Stream0=merge_7, Stream1=merge_6)
item_6 = ListItem(List=filter_8, Index=0, Wrap=True)  # -> Item, Item1

# ---- group: 房间面宽小，书桌缩放 (continued)
end = EndPoints(Curve=item_6.Item)  # -> Start, End

# ----
# 房间面宽过小，榻榻米延申至墙
len = Length(Curve=窗所在边线)
房间面宽 = Panel("2.4")
smaller = SmallerThan(FirstNumber=len, SecondNumber=房间面宽)  # -> SmallerThan, OrEqualTo

# ---- group: 生成吊柜
吊柜下托板高度 = Slider(0.24, range=0..1)
吊柜高度 = Slider(0.45, range=0..1)
房间高度_2 = Slider(2.5, range=0..10)
最大矩形_12 = Curve(最大矩形_4)

# ---- group: 生成书柜
柜子厚度 = Slider(0.35, range=0..1)
t值 = Panel("0.5")
门线_2 = Curve(门线)

# ---- group: 生成衣柜
门线_3 = Curve(reparameterize(门线))
待测线 = Curve(item_5.Item)
矫正曲线_方向指向门线_2 = 矫正曲线方向指向门线(crv=待测线, dorcrv=门线_3)  # -> s_0, vec_2
衣柜宽度 = Slider(0.5, range=0..1)
end_2 = EndPoints(Curve=矫正曲线_方向指向门线_2.s_0)  # -> Start, End
让出门的位置 = Panel("0.9")
最大矩形_13 = Curve(最大矩形_7)
filter_9 = StreamFilter(Gate=python_7.a, Stream0=衣柜宽度, Stream1=让出门的位置)

# ----
subtraction = Subtraction(A=len, B=filter_9)

# ---- group: 椅子定位点
最大矩形_14 = Curve(最大矩形_6)
椅子相对书桌内边距离 = Panel("0.65")

# ----
最大矩形_15 = Curve(最大矩形_14)

# ---- group: 根据边线中点生成榻榻米
矫正曲线_方向指向门线_3 = 矫正曲线方向指向门线_2(crv=窗所在边线, dorcrv=门线_3)  # -> s_1, vec_2
rev_4 = Reverse(Vector=矫正曲线_方向指向门线_3.vec_2)
end_3 = EndPoints(Curve=矫正曲线_方向指向门线_3.s_1)  # -> Start, End
line = LineSDL(Start=end_2.Start, Direction=rev_4, Length=filter_9)
end_4 = EndPoints(Curve=line)  # -> Start, End
pt = Point(end_3.Start)
榻榻米底柜厚度 = Panel("0.01")
柜子单元长度 = Slider(0.25, range=0..1)
最大矩形_16 = Curve(最大矩形_9)

# ---- group: 生成书柜
房间高度_3 = Panel("2.5")
单柜高度_2 = Panel("0.35")

# ---- group: 生成边柜
multiplication = Multiplication(A=panel, B=书桌宽度)
line_2 = LineSDL(Start=pt, Direction=矫正曲线_方向指向门线_3.vec_2, Length=multiplication)
榻榻米边柜线 = Curve(line_2)
最大矩形_17 = Curve(最大矩形_8)

# ---- group: 根据边线中点生成榻榻米 (continued)
end_5 = EndPoints(Curve=line_2)  # -> Start, End
ln = Line(StartPoint=end_4.End, EndPoint=end_5.End)
len_2 = Length(Curve=ln)

# ----
end_6 = EndPoints(Curve=ln)  # -> Start, End
榻榻米边线_长度 = Merge(Data1=ln, Data2=len_2)
line_3 = LineSDL(Start=end_6.Start, Direction=rev_4, Length=subtraction)
len_3 = Length(Curve=line_3)
榻榻米边线_长度_2 = Merge(Data1=line_3, Data2=len_3)
filter_10 = StreamFilter(Gate=smaller.SmallerThan, Stream0=榻榻米边线_长度, Stream1=榻榻米边线_长度_2)
item_7 = ListItem(List=filter_10, Index=0, Wrap=True)  # -> Item, Item1

# ---- group: 根据边线中点生成榻榻米
榻榻米宽 = Slider(1.2, range=0..10)
榻榻米边线 = Curve(item_7.Item)
榻榻米高 = Panel("0.3")

# ---- group: 房间面宽小，书桌缩放 (continued)
amp_2 = Amplitude(Vector=item_6.Item1, Amplitude=榻榻米宽)
move_3 = Move(Geometry=end.Start, Motion=amp_2)  # -> Geometry, Transform
ln_2 = Line(StartPoint=move_3.Geometry, EndPoint=end.End)
filter_11 = StreamFilter(Gate=smaller.SmallerThan, Stream0=filter_7, Stream1=ln_2)

# ---- group: 生成书桌 (continued)
书桌线 = Curve(filter_11)
生成书桌 = 生成书桌(最大矩形=最大矩形_11, G=书桌线, F=书桌高度, A=书桌宽度, B=panel, F_2=抽屉高度)  # -> M_2, M
mjoin_3 = MeshJoin(Meshes=flatten(生成书桌.M))
mjoin_4 = MeshJoin(Meshes=flatten(生成书桌.M_2))

# ---- group: 生成吊柜 (continued)
书桌线_2 = Curve(filter_11)
生成吊柜 = 生成吊柜(最大矩形=最大矩形_12, G=书桌线_2, F=房间高度_2, A=书桌宽度, F_2=吊柜高度, F_3=吊柜下托板高度)  # -> 吊柜_2, 吊柜门
mjoin_5 = MeshJoin(Meshes=生成吊柜.吊柜_2)

# ---- group: 椅子定位点 (continued)
书桌线_3 = Curve(书桌线_2)
矫正曲线_方向指向门线_4 = 矫正曲线方向指向门线(crv=书桌线_3, dorcrv=门线)  # -> s_0, vec_2
flip_2 = FlipCurve(Curve=矫正曲线_方向指向门线_4.s_0)  # -> Curve, Flag
vec_2 = Vector(flip_2.Curve)
end_7 = EndPoints(Curve=flip_2.Curve)  # -> Start, End
len_4 = Length(Curve=书桌线_3)
python_8 = GhPythonScript(x=smaller.SmallerThan, y=len_4, z=榻榻米宽)  # -> out, a
# ---------- python_8: Python ----------
"""
x:表示有无榻榻米边书桌
x为false， 表示书桌通长
x为true，表示书桌不通长

y:书桌线长度
z:榻榻米宽度
"""

if(not x):
    a = y - z
else:
    a = y
# ---------- end python_8 ----------
line_4 = LineSDL(Start=end_7.Start, Direction=vec_2, Length=python_8.a)
指向内部向量_2 = 指向内部向量_2(C_2=最大矩形_14, C=line_4)
amp_3 = Amplitude(Vector=指向内部向量_2, Amplitude=椅子相对书桌内边距离)
move_4 = Move(Geometry=line_4, Motion=amp_3)  # -> Geometry, Transform
python_9 = GhPythonScript(length=len_4)  # -> out, a
# ---------- python_9: Python ----------
if(length <= 1.8):
    a = 2
else:
    a = 3
# ---------- end python_9 ----------
divide = DivideCurve(Curve=move_4.Geometry, Count=python_9.a, Kinks=False)  # -> Points, Tangents, Parameters
python_10 = GhPythonScript(x=divide.Points)  # -> out, a; inputs x: list of Point3d
# ---------- python_10: Python ----------
x.pop()
x.reverse()
x.pop()

a = x
# ---------- end python_10 ----------
椅子定位点 = Point(python_10.a)

# ---- group: 生成衣柜 (continued)
line_5 = LineSDL(Start=end_2.Start, Direction=矫正曲线_方向指向门线_2.vec_2, Length=榻榻米宽)
衣柜线 = Curve(line_5)
判断窗是否位于开门靠墙侧 = StreamFilter(Gate=python_7.a, Stream0=衣柜线)
生成衣柜 = 生成衣柜(最大矩形=最大矩形_13, C=判断窗是否位于开门靠墙侧, A=衣柜宽度, F=房间高度_2)  # -> M, 柜门
mjoin_6 = MeshJoin(Meshes=生成衣柜.柜门)
mjoin_7 = MeshJoin(Meshes=生成衣柜.M)

# ----
mjoin_8 = MeshJoin(Meshes=生成吊柜.吊柜门)
crv_2 = Curve(move_4.Geometry)
椅子定位点_2 = Point(椅子定位点)

# ---- group: 摆放类家具
area = Area(Geometry=最大矩形_15)  # -> Area, Centroid
mesh_2 = Mesh(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)
摆放家具 = 摆放家具0416(家具=mesh_2, 参考点="1", 定位点=graft(椅子定位点_2), 向心=graft(area.Centroid), 背靠线方向=graft(crv_2), 面向线=Toggle(True), z方向位移=0)  # -> graft(geo_2), graft(A), graft(G), 三轴旋转角_2, 旋转矩阵
c_script_13 = CSharpScript(x=摆放家具.geo_2, name="office_chair_500", plane=摆放家具.G, rotate=摆放家具.三轴旋转角_2)  # -> out, A; inputs name: String, plane: String, rotate: String, tag: String
# ---------- c_script_13: C# ----------
    var outputs = new List<object>(); // 存储输出的列表

    // 检查输入是否为 GH_GeometryGroup
    List<object> group = x as List<object>;
    List<object> groups = new List<object>();
    if (group != null)
    {
      foreach (object goo in group)
      {
        GeometryBase geom = goo as GeometryBase;
        if (geom != null)
        {
          // 为每个几何对象设置用户字典数据
          if (name != null)
          {
            geom.UserDictionary.Set("name", name);
          }
          if (plane != null)
          {
            geom.UserDictionary.Set("plane", plane);
          }
          if (rotate != null)
          {
            geom.UserDictionary.Set("rotate", rotate);
          }
          if (tag != null)
          {
            geom.UserDictionary.Set("tag", tag);
          }
          groups.Add(geom);

        }
      }
      GH_GeometryGroup grp = new GH_GeometryGroup();
      var goos = groups.Select(m => GH_Convert.ToGeometricGoo(m));
      grp.Objects.AddRange(goos);
      outputs.Add(grp);
    }


    else
    {
      // 尝试直接将输入转换为 GeometryBase
      GeometryBase geom = x as GeometryBase;
      if (geom != null)
      {
        // 为单个几何对象设置用户字典数据
        if (name != null)
        {
          geom.UserDictionary.Set("name", name);
        }
        if (plane != null)
        {
          geom.UserDictionary.Set("plane", plane);
        }
        if (rotate != null)
        {
          geom.UserDictionary.Set("rotate", rotate);
        }
        if (tag != null)
        {
          geom.UserDictionary.Set("tag", tag);
        }

        // 添加到输出列表
        outputs.Add(geom);
      }
    }

    // 输出修改后的几何对象
    A = outputs;
# ---------- end c_script_13 ----------
椅子 = Geometry(flatten(c_script_13.A))

# ----
衣柜体 = ClusterOutput(mjoin_7)
书桌线_4 = ClusterOutput(书桌线)
吊柜 = ClusterOutput(mjoin_8)
衣柜门 = ClusterOutput(mjoin_6)
吊柜_2 = ClusterOutput(mjoin_5)
书桌 = ClusterOutput(mjoin_4)
椅子_2 = ClusterOutput(椅子)
书桌抽屉 = ClusterOutput(mjoin_3)

# ---- group: 生成书柜 (continued)
end_8 = EndPoints(Curve=line_5)  # -> Start, End
ln_3 = Line(StartPoint=end_8.End, EndPoint=end_2.End)
书柜线 = Curve(ln_3)
cluster_2 = Cluster_6(最大矩形=最大矩形_5, crv=书柜线, door=门线_2, L=柜子厚度, t=t值)
凹形轮廓线 = Curve(cluster_2)

cluster_3 = Cluster_5(凹槽线=凹形轮廓线, A=房间高度_3, F=单柜高度_2)
mjoin_9 = MeshJoin(Meshes=cluster_3)

filter_12 = StreamFilter(Gate=python_4.a, Stream0=mjoin_9)
书柜 = Geometry(filter_12)
filter_13 = StreamFilter(Gate=python_5.a, Stream1=书柜)
书柜_2 = Mesh(filter_13)

# ----
书柜_3 = ClusterOutput(书柜_2)

# ---- group: 生成边柜 (continued)
生成榻榻米边柜 = 生成榻榻米边柜(最大矩形=最大矩形_17, A=榻榻米宽, C=榻榻米边柜线, A_2=书桌高度, B=抽屉高度, A_3=榻榻米底柜厚度)  # -> 榻榻米边柜体, 榻榻米边柜门
mjoin_10 = MeshJoin(Meshes=生成榻榻米边柜.榻榻米边柜体)

# ----
mjoin_11 = MeshJoin(Meshes=生成榻榻米边柜.榻榻米边柜门)

# ---- group: 生成边柜 (continued)
merge_8 = Merge(Data1=mjoin_10, Data2=mjoin_11)

# ----
# 房间面宽过小，取消边柜
filter_14 = StreamFilter(Gate=smaller.SmallerThan, Stream0=merge_8)

item_8 = ListItem(List=filter_14, Index=0, Wrap=True)  # -> Item, Item1
榻榻米边柜门 = Mesh(item_8.Item1)
榻榻米边柜体 = Mesh(item_8.Item)
榻榻米边柜体_2 = ClusterOutput(榻榻米边柜体)
榻榻米边柜门_2 = ClusterOutput(榻榻米边柜门)

# ---- group: 根据边线中点生成榻榻米 (continued)
指向内部向量_3 = 指向内部向量(C_2=最大矩形_16, C=榻榻米边线)
生成榻榻米 = 生成榻榻米(V=指向内部向量_3, L=柜子单元长度, C=榻榻米边线, A=榻榻米宽, A_2=item_7.Item1, F=榻榻米高, _1=榻榻米底柜厚度)  # -> 榻榻米底柜, M
mjoin_12 = MeshJoin(Meshes=生成榻榻米.M)
榻榻米 = Geometry(mjoin_12)

# ----
mjoin_13 = MeshJoin(Meshes=生成榻榻米.榻榻米底柜)

# ---- group: 根据边线中点生成榻榻米 (continued)
榻榻米底柜 = Geometry(mjoin_13)
merge_9 = Merge(Data1=榻榻米, Data2=榻榻米底柜)  # -> flatten(Result)

# ----
rev_5 = Reverse(Vector=rev_4)
最大矩形_18 = Curve(最大矩形_10)
len_5 = Length(Curve=line)
explode_3 = Explode(Curve=最大矩形_18, Recursive=True)  # -> Segments, Vertices
c_script_14 = CSharpScript(crvs=explode_3.Segments, vec=rev_5)  # -> out, A; inputs crvs: list of Curve, vec: Vector3d
# ---------- c_script_14: C# ----------
    foreach(Curve crv in crvs)
    {
      if(Vector3d.Multiply(crv.TangentAtStart, vec) != 0)
      {
        A = crv.GetLength();
        break;
      }
    }
# ---------- end c_script_14 ----------
addition = Addition(A=len_5, B=c_script_14.A)
amp_4 = Amplitude(Vector=rev_5, Amplitude=addition)
move_5 = Move(Geometry=merge_9, Motion=amp_4)  # -> Geometry, Transform
filter_15 = StreamFilter(Gate=python_6.a, Stream0=move_5.Geometry, Stream1=merge_9)
item_9 = ListItem(List=filter_15, Index=0, Wrap=True)  # -> Item, Item1
榻榻米底柜_2 = Mesh(item_9.Item1)
榻榻米_2 = Mesh(item_9.Item)

榻榻米_3 = ClusterOutput(榻榻米_2)
榻榻米底柜_3 = ClusterOutput(榻榻米底柜_2)

# ==== cluster 生成榻榻米
C = ClusterInput()
unit = UnitVector(Vector=C)
Z = UnitZ(Factor=1)
midpt = CurveMiddle(Curve=C)
V = ClusterInput()
vrot = Rotate(Vector=unit, Axis=Z, Angle=degrees(90))
A = ClusterInput()
A_2 = ClusterInput()
amp = Amplitude(Vector=V, Amplitude=expr("x/2", A))
multiplication = Multiplication(A=V, B=vrot)
dom = ConstructDomain(DomainStart=expr("x/2", A_2), DomainEnd=expr("-x/2", A_2))
榻榻米中心点 = Move(Geometry=midpt, Motion=amp)  # -> Geometry, Transform
dom_2 = ConstructDomain(DomainStart=expr("x/2", A), DomainEnd=expr("-x/2", A))
F = ClusterInput()
smaller = SmallerThan(FirstNumber=multiplication, SecondNumber="0")  # -> SmallerThan, OrEqualTo
pl = ConstructPlane(Origin=榻榻米中心点.Geometry, XAxis=unit, YAxis=V)
Z_2 = UnitZ(Factor=F)
rectangle = Rectangle(Plane=pl, XSize=dom, YSize=dom_2, Radius=0)  # -> Rectangle, Length
explode = Explode(Curve=rectangle.Rectangle, Recursive=True)  # -> reparameterize(Segments), Vertices
srf = Surface(rectangle.Rectangle)
c_script = CSharpScript(crvs=explode.Segments, pt=midpt, vec=unit)  # -> out, A; inputs crvs: list of Curve, pt: Point3d, vec: Vector3d
# ---------- c_script: C# ----------
    Curve result = null;
    foreach(var crv in crvs)
    {
      var point = crv.PointAt(0.5);
      if(pt.CompareTo(point) == 0)
      {
        continue;
      }
      Vector3d vector = point - pt;
      if(Vector3d.VectorAngle(vector, vec) - Math.PI * 0.5 < 0.1)
      {
        result = crv;
      }
    }

    A = result;
# ---------- end c_script ----------
extr = Extrude(Base=srf, Direction=Z_2)
_1 = ClusterInput()
榻榻米柜子底边 = Curve(c_script.A)
L = ClusterInput()
divlength = DivideLength(Curve=榻榻米柜子底边, Length=L)  # -> Points, Tangents, Parameters
multiplication_2 = Multiplication(A=_1, B=-1)
shatter = Shatter(Curve=榻榻米柜子底边, Parameters=divlength.Parameters)
extr_2 = Extrude(Base=shatter, Direction=Z_2)
filter = StreamFilter(Gate=smaller.SmallerThan, Stream0=multiplication_2, Stream1=_1)
move = Move(Geometry=shatter, Motion=Z_2)  # -> Geometry, Transform
amp_2 = Amplitude(Vector=V, Amplitude=_1)
len = Length(Curve=shatter)
move_2 = Move(Geometry=move.Geometry, Motion=amp_2)  # -> Geometry, Transform
crv = Curve(extr_2)
multiplication_3 = Multiplication(A=len, B=0.25)
multiplication_4 = Multiplication(A=_1, B=0.5)
multiplication_5 = Multiplication(A=_1, B=1)
midpt_2 = CurveMiddle(Curve=move_2.Geometry)
boxrec = BoxRectangle(Rectangle=crv, Height=filter)
pl_2 = ConstructPlane(Origin=midpt_2, XAxis=unit, YAxis=V)
python = GhPythonScript(breps=boxrec)  # -> out, a; inputs breps: list of Brep
# ---------- python: Python ----------
import Rhino.Geometry as rg

def unify_brep(brep):
    o = brep.SolidOrientation
    if o != rg.BrepSolidOrientation.Outward:
        brep.Flip()
        
    return brep

a = []
for brep in breps:
    a.append(unify_brep(brep))
# ---------- end python ----------
box = CenterBox(Base=pl_2, X=multiplication_3, Y=multiplication_4, Z=multiplication_5)
mjoin = MeshJoin(Meshes=flatten(extr))
python_2 = GhPythonScript(breps=box)  # -> out, a; inputs breps: list of Brep; same code as python
mdif = MeshDifference(MeshesA=python.a, MeshesB=python_2.a)
M = ClusterOutput(mjoin)
榻榻米底柜 = ClusterOutput(mdif)

# ==== cluster Cluster_4
凹槽线 = ClusterInput()
凹槽线_2 = Curve(凹槽线)
end = EndPoints(Curve=凹槽线_2)  # -> Start, End
木板厚度 = Panel("0.01")
F = ClusterInput()
ln = Line(StartPoint=end.Start, EndPoint=end.End)
A = ClusterInput()
join = JoinCurves(Curves=[凹槽线_2, ln], Preserve=False)
向内偏移曲线 = 向内偏移曲线(C=凹槽线_2, D=木板厚度)
srf = Surface(join)
Z = UnitZ(Factor=木板厚度)
division = Division(A=A, B=F)
crv = Curve(向内偏移曲线)
loft = Loft(
    Curves=flatten([crv, 凹槽线_2]),
    Options={Adjust=False, Closed=False, LoftEnds=0, LoftSimp=0, LoftType=0, Rebuild=10, Refit=0.01})
extr = Extrude(Base=srf, Direction=Z)
round = Round(Number=division)  # -> Nearest, Floor, Ceiling
Z_2 = UnitZ(Factor=F)
crv_2 = Curve(loft)
arrlinear = LinearArray(Geometry=extr, Direction=Z_2, Count=expr("x+1", round.Nearest))  # -> Geometry, Transform
multiplication = Multiplication(A=F, B=round.Nearest)
Z_3 = UnitZ(Factor=multiplication)
extr_2 = Extrude(Base=crv_2, Direction=Z_3)
mesh = MeshBrep(
    Brep=flatten([extr_2, arrlinear.Geometry]),
    Settings={GridMaxCount=0, GridMinCount=16, JaggedSeams=False, MaxEdgeLength=0, MinEdgeLength=0.0001, MinTolerance=0, Refine=True, RefineAngle=0, RelativeTolerance=0.65, SimplePlanes=True, Tolerance=0})
M = ClusterOutput(mesh)

# ==== cluster Cluster_5
凹槽线 = ClusterInput()
凹槽线_2 = Curve(凹槽线)
end = EndPoints(Curve=凹槽线_2)  # -> Start, End
木板厚度 = Panel("0.01")
F = ClusterInput()
ln = Line(StartPoint=end.Start, EndPoint=end.End)
A = ClusterInput()
join = JoinCurves(Curves=[凹槽线_2, ln], Preserve=False)
向内偏移曲线 = 向内偏移曲线_2(C=凹槽线_2, D=木板厚度)
srf = Surface(join)
Z = UnitZ(Factor=木板厚度)
division = Division(A=A, B=F)
crv = Curve(向内偏移曲线)
loft = Loft(
    Curves=flatten([crv, 凹槽线_2]),
    Options={Adjust=False, Closed=False, LoftEnds=0, LoftSimp=0, LoftType=0, Rebuild=10, Refit=0.01})
extr = Extrude(Base=srf, Direction=Z)
round = Round(Number=division)  # -> Nearest, Floor, Ceiling
Z_2 = UnitZ(Factor=F)
crv_2 = Curve(loft)
arrlinear = LinearArray(Geometry=extr, Direction=Z_2, Count=expr("x+1", round.Nearest))  # -> Geometry, Transform
multiplication = Multiplication(A=F, B=round.Nearest)
Z_3 = UnitZ(Factor=multiplication)
extr_2 = Extrude(Base=crv_2, Direction=Z_3)
mesh = MeshBrep(
    Brep=flatten([extr_2, arrlinear.Geometry]),
    Settings={GridMaxCount=0, GridMinCount=16, JaggedSeams=False, MaxEdgeLength=0, MinEdgeLength=0.0001, MinTolerance=0, Refine=True, RefineAngle=0, RelativeTolerance=0.65, SimplePlanes=True, Tolerance=0})
M = ClusterOutput(mesh)

# ==== cluster Cluster_6
crv = ClusterInput()
door = ClusterInput()
c_script = CSharpScript(crv=crv, door=door)  # -> out, A; inputs crv: Curve, door: Curve
# ---------- c_script: C# ----------
    var sPt = door.PointAtStart;
    var ePt = door.PointAtEnd;

    var ssPt = crv.PointAt(0);
    var eePt = crv.PointAt(1);
    var result = false;
    if(ssPt.CompareTo(sPt) == 0 || ssPt.CompareTo(ePt) == 0)
    {
      result = true;
    }

    A = result;
# ---------- end c_script ----------
flip = FlipCurve(Curve=crv)  # -> Curve, Flag
t = ClusterInput()
filter = StreamFilter(Gate=c_script.A, Stream0=crv, Stream1=flip.Curve)
最大矩形 = ClusterInput()
shatter = Shatter(Curve=reparameterize(filter), Parameters=t)
最大矩形_2 = Curve(最大矩形)
item = ListItem(List=shatter, Index=0, Wrap=True)
指向内部向量 = 指向内部向量(C_2=最大矩形_2, C=item)
vec = Vector(指向内部向量)
end = EndPoints(Curve=item)  # -> Start, End
L = ClusterInput()
line = LineSDL(Start=end.End, Direction=vec, Length=L)
line_2 = LineSDL(Start=end.Start, Direction=vec, Length=L)
join = JoinCurves(Curves=[line_2, line, item], Preserve=False)
C = ClusterOutput(join)

# ==== cluster 生成书桌
F = ClusterInput()
G = ClusterInput()
Z = UnitZ(Factor=F)
move = Move(Geometry=G, Motion=Z)  # -> Geometry, Transform
抽屉宽度 = Panel("0.35")
最大矩形 = ClusterInput()
F_2 = ClusterInput()
A = ClusterInput()
指向内部向量 = 指向内部向量(C_2=最大矩形, C=move.Geometry)
B = ClusterInput()
amp = Amplitude(Vector=指向内部向量, Amplitude=A)
multiplication = Multiplication(A=amp, B=B)
move_2 = Move(Geometry=move.Geometry, Motion=multiplication)  # -> Geometry, Transform
divlength = DivideLength(Curve=move_2.Geometry, Length=抽屉宽度)  # -> Points, Tangents, Parameters
shatter = Shatter(Curve=move_2.Geometry, Parameters=divlength.Parameters)  # -> reparameterize(Segments)
len = Length(Curve=shatter)
桌面高度 = Panel("0.01")
extr = Extrude(Base=move.Geometry, Direction=amp)
extr_2 = Extrude(Base=move.Geometry, Direction=multiplication)
Z_2 = UnitZ(Factor=expr("-x", F_2))
multiplication_2 = Multiplication(A=len, B=Slider(0.01, range=0..0.1))
Z_3 = UnitZ(Factor=桌面高度)
ext = ExtendCurve(Curve=reparameterize(shatter), Type=0, Start=expr("-x", multiplication_2), End=expr("-x", multiplication_2))
amp_2 = Amplitude(Vector=指向内部向量, Amplitude=Slider(0.005, range=0..0.01))
extr_3 = Extrude(Base=ext, Direction=Z_2)
extr_4 = Extrude(Base=extr_2, Direction=Z_2)
extr_5 = Extrude(Base=extr_3, Direction=amp_2)
extr_6 = Extrude(Base=extr, Direction=Z_3)
mesh = MeshBrep(
    Brep=extr_5,
    Settings={GridMaxCount=0, GridMinCount=16, JaggedSeams=False, MaxEdgeLength=0, MinEdgeLength=0.0001, MinTolerance=0, Refine=True, RefineAngle=0, RelativeTolerance=0.65, SimplePlanes=True, Tolerance=0})
mesh_2 = MeshBrep(
    Brep=[extr_6, extr_4],
    Settings={GridMaxCount=0, GridMinCount=16, JaggedSeams=False, MaxEdgeLength=0, MinEdgeLength=0.0001, MinTolerance=0, Refine=True, RefineAngle=0, RelativeTolerance=0.65, SimplePlanes=True, Tolerance=0})
M = ClusterOutput(mesh)
M_2 = ClusterOutput(mesh_2)

# ==== cluster 生成衣柜
最大矩形 = ClusterInput()
C = ClusterInput()
A = ClusterInput()
指向内部向量 = 指向内部向量(C_2=最大矩形, C=C)
F = ClusterInput()
amp = Amplitude(Vector=指向内部向量, Amplitude=A)
Z = UnitZ(Factor=F)
move = Move(Geometry=C, Motion=amp)  # -> Geometry, Transform
extr = Extrude(Base=C, Direction=amp)
extr_2 = Extrude(Base=extr, Direction=Z)
debrep = DeconstructBrep(Brep=extr_2)  # -> Faces, Edges, Vertices
move_2 = Move(Geometry=move.Geometry, Motion=Z)  # -> Geometry, Transform
厚度 = Panel("0.01")
item = ListItem(List=debrep.Faces, Index=0, Wrap=True)  # -> Item, Item1, Item2, Item3, Item4

# ---- group: 判断柜门数量
c_script = CSharpScript(crv=move_2.Geometry)  # -> out, A; inputs crv: Curve
# ---------- c_script: C# ----------
    var len = crv.GetLength();
    if(len <= 0.4)
    {
      A = 1;
    }else if(len <= 0.8)
    {
      A = 2;
    }else if(len <= 1.2)
    {
      A = 3;
    }else if(len <= 1.6)
    {
      A = 4;
    }else if(len <= 2.0)
    {
      A = 5;
    }else if(len <= 2.4)
    {
      A = 6;
    }else
    {
      A = 7;
    }
# ---------- end c_script ----------

# ----
multiplication = Multiplication(A=F, B=Slider(0.8, range=0..1))
subtraction = Subtraction(A=F, B=厚度)
join = BrepJoin(Breps=[item.Item1, item.Item3, item.Item4])  # -> Breps, Closed
Z_2 = UnitZ(Factor=multiplication)
Z_3 = UnitZ(Factor=subtraction)
move_3 = Move(Geometry=C, Motion=Z_2)  # -> Geometry, Transform
divide = DivideCurve(Curve=reparameterize(move_2.Geometry), Count=c_script.A, Kinks=False)  # -> Points, Tangents, Parameters
offsetbrep = OffsetBrep(Brep=join.Breps, Distance=expr("-X", 厚度), Both=False, Solid=True, MergeAllCoplanarFaces=True)
extr_3 = Extrude(Base=move_3.Geometry, Direction=amp)
shatter = Shatter(Curve=reparameterize(move_2.Geometry), Parameters=divide.Parameters)
Z_4 = UnitZ(Factor=厚度)
extr_4 = Extrude(Base=extr, Direction=Z_4)
move_4 = Move(Geometry=extr_4, Motion=Z_3)  # -> Geometry, Transform
extr_5 = Extrude(Base=extr_3, Direction=Z_4)
python = GhPythonScript(x=shatter)  # -> out, a, b; inputs x: list
# ---------- python: Python ----------
b = x.pop()
a = x
# ---------- end python ----------
len = Length(Curve=python.a)
柜门厚度 = Slider(0.01, range=0..0.01)
柜门所占比例 = Slider(0.79, range=0..1)
multiplication_2 = Multiplication(A=len, B=Slider(0.05, range=0..1))
ext = ExtendCurve(Curve=python.a, Type=0, Start=0, End=expr("-x", multiplication_2))
rev = Reverse(Vector=指向内部向量)
merge = Merge(Data1=ext, Data2=python.b)
amp_2 = Amplitude(Vector=指向内部向量, Amplitude=柜门厚度)
multiplication_3 = Multiplication(A=F, B=柜门所占比例)
amp_3 = Amplitude(Vector=rev, Amplitude=厚度)
extr_6 = Extrude(Base=merge, Direction=amp_2)
Z_5 = UnitZ(Factor=expr("-x", multiplication_3))
python_2 = GhPythonScript(x=merge)  # -> out, a; inputs x: list
# ---------- python_2: Python ----------
l = len(x)
print(l)
if(l <= 2):
    a = 0
elif(l == 3):
    a = 1
else:
    a = l - 2
# ---------- end python_2 ----------
extr_7 = Extrude(Base=move.Geometry, Direction=Z)
extr_8 = Extrude(Base=extr_7, Direction=amp_3)
item_2 = ListItem(List=merge, Index=python_2.a, Wrap=True)
extr_9 = Extrude(Base=extr_6, Direction=Z_5)
end = EndPoints(Curve=item_2)  # -> Start, End
line = LineSDL(Start=end.Start, Direction=expr("-x", Vector(0, 0, 1)), Length=F)
neg = Negative(Value=amp)
mesh = MeshBrep(
    Brep=flatten(extr_9),
    Settings={GridMaxCount=0, GridMinCount=16, JaggedSeams=False, MaxEdgeLength=0, MinEdgeLength=0.0001, MinTolerance=0, Refine=True, RefineAngle=0, RelativeTolerance=0.65, SimplePlanes=True, Tolerance=0})
vec = Vector(item_2)
extr_10 = Extrude(Base=line, Direction=neg)
unit = UnitVector(Vector=vec)
柜门 = ClusterOutput(mesh)
multiplication_4 = Multiplication(A=unit, B=厚度)
extr_11 = Extrude(Base=extr_10, Direction=multiplication_4)
mesh_2 = MeshBrep(
    Brep=flatten([move_4.Geometry, extr_5, extr_4, offsetbrep, extr_11, extr_8]),
    Settings={GridMaxCount=0, GridMinCount=16, JaggedSeams=False, MaxEdgeLength=0, MinEdgeLength=0.0001, MinTolerance=0, Refine=True, RefineAngle=0, RelativeTolerance=0.65, SimplePlanes=True, Tolerance=0})
M = ClusterOutput(mesh_2)

# ==== cluster 生成吊柜
F = ClusterInput()
G = ClusterInput()
Z = UnitZ(Factor=F)
move = Move(Geometry=G, Motion=Z)  # -> Geometry, Transform
最大矩形 = ClusterInput()
抽屉宽度 = Panel("0.35")
指向内部向量 = 指向内部向量(C_2=最大矩形, C=move.Geometry)
A = ClusterInput()
amp = Amplitude(Vector=指向内部向量, Amplitude=A)
move_2 = Move(Geometry=move.Geometry, Motion=amp)  # -> Geometry, Transform
divlength = DivideLength(Curve=move_2.Geometry, Length=抽屉宽度)  # -> Points, Tangents, Parameters
shatter = Shatter(Curve=move_2.Geometry, Parameters=divlength.Parameters)  # -> reparameterize(Segments)
F_2 = ClusterInput()
len = Length(Curve=shatter)
Z_2 = UnitZ(Factor=F_2)
extr = Extrude(Base=move.Geometry, Direction=amp)
multiplication = Multiplication(A=len, B=Slider(0.01, range=0..0.1))
F_3 = ClusterInput()
ext = ExtendCurve(Curve=reparameterize(shatter), Type=0, Start=expr("-x", multiplication), End=expr("-x", multiplication))
move_3 = Move(Geometry=move.Geometry, Motion=expr("-x", Z_2))  # -> Geometry, Transform
amp_2 = Amplitude(Vector=指向内部向量, Amplitude=Slider(0.005, range=0..0.01))
extr_2 = Extrude(Base=extr, Direction=expr("-x", Z_2))
Z_3 = UnitZ(Factor=F_3)
extr_3 = Extrude(Base=ext, Direction=expr("-x", Z_2))
extr_4 = Extrude(Base=move_3.Geometry, Direction=expr("-x", Z_3))
move_4 = Move(Geometry=move_3.Geometry, Motion=expr("-x", Z_3))  # -> Geometry, Transform
板厚 = Panel("0.01")
隔板内部吊板数量 = Slider(3, range=0..10)
extr_5 = Extrude(Base=extr_3, Direction=amp_2)
extr_6 = Extrude(Base=move_4.Geometry, Direction=amp)
Z_4 = UnitZ(Factor=板厚)
lng = ListLength(List=len)
item = ListItem(List=len, Index=0, Wrap=True)
extr_7 = Extrude(Base=extr_6, Direction=Z_4)
amp_3 = Amplitude(Vector=指向内部向量, Amplitude=板厚)
division = Division(A=lng, B=隔板内部吊板数量)
multiplication_2 = Multiplication(A=item, B=隔板内部吊板数量)
round = Round(Number=division)  # -> Nearest, Floor, Ceiling
extr_8 = Extrude(Base=extr_4, Direction=amp_3)
end = EndPoints(Curve=move_4.Geometry)  # -> Start, End
python = GhPythonScript(x=multiplication_2, y=round.Nearest)  # -> out, a
# ---------- python: Python ----------
a = []
for i in range(y - 1):
    a.append(x * (i + 1))
# ---------- end python ----------
line = LineSDL(Start=end.Start, Direction=指向内部向量, Length=A)
vec2pt = Vector2Pt(PointA=end.Start, PointB=end.End, Unitize=False)  # -> Vector, Length
line_2 = LineSDL(Start=end.End, Direction=指向内部向量, Length=A)
Z_5 = UnitZ(Factor=F_3)
unit = UnitVector(Vector=vec2pt.Vector)
amp_4 = Amplitude(Vector=unit, Amplitude=python.a)
extr_9 = Extrude(Base=line, Direction=Z_5)
extr_10 = Extrude(Base=line_2, Direction=Z_5)
amp_5 = Amplitude(Vector=unit, Amplitude=板厚)
extr_11 = Extrude(Base=extr_10, Direction=expr("-x", amp_5))
extr_12 = Extrude(Base=extr_9, Direction=amp_5)
move_5 = Move(Geometry=extr_12, Motion=amp_4)  # -> Geometry, Transform
merge = Merge(Data1=extr_2, Data2=extr_8, Data3=extr_7, Data4=extr_12, Data5=extr_11, Data6=move_5.Geometry)  # -> flatten(Result)
mesh = MeshBrep(
    Brep=extr_5,
    Settings={GridMaxCount=0, GridMinCount=16, JaggedSeams=False, MaxEdgeLength=0, MinEdgeLength=0.0001, MinTolerance=0, Refine=True, RefineAngle=0, RelativeTolerance=0.65, SimplePlanes=True, Tolerance=0})
吊柜 = MeshBrep(
    Brep=merge,
    Settings={GridMaxCount=0, GridMinCount=16, JaggedSeams=False, MaxEdgeLength=0, MinEdgeLength=0.0001, MinTolerance=0, Refine=True, RefineAngle=0, RelativeTolerance=0.65, SimplePlanes=True, Tolerance=0})
吊柜门 = ClusterOutput(mesh)
吊柜_2 = ClusterOutput(吊柜)

# ==== cluster 生成榻榻米边柜
最大矩形 = ClusterInput()
C = ClusterInput()
指向内部向量 = 指向内部向量_2(C_2=最大矩形, C=C)
A = ClusterInput()
A_2 = ClusterInput()
B = ClusterInput()
amp = Amplitude(Vector=指向内部向量, Amplitude=A)
A_3 = ClusterInput()
move = Move(Geometry=C, Motion=amp)  # -> Geometry, Transform
subtraction = Subtraction(A=A_2, B=B)
extr = Extrude(Base=C, Direction=amp)
amp_2 = Amplitude(Vector=指向内部向量, Amplitude=A_3)
Z = UnitZ(Factor=subtraction)
extr_2 = Extrude(Base=move.Geometry, Direction=amp_2)
extr_3 = Extrude(Base=extr, Direction=Z)
extr_4 = Extrude(Base=extr_2, Direction=Z)
mesh = MeshBrep(
    Brep=[extr_3, extr_2],
    Settings={GridMaxCount=0, GridMinCount=16, JaggedSeams=False, MaxEdgeLength=0, MinEdgeLength=0.0001, MinTolerance=0, Refine=True, RefineAngle=0, RelativeTolerance=0.65, SimplePlanes=True, Tolerance=0})
榻榻米边柜体 = ClusterOutput(mesh)
榻榻米边柜门 = ClusterOutput(extr_4)

# ==== cluster 矫正曲线方向指向门线
crv = ClusterInput()
dorcrv = ClusterInput()
c_script = CSharpScript(crv=crv, dorCrv=dorcrv)  # -> out, A; inputs crv: Curve, dorCrv: Curve
# ---------- c_script: C# ----------
    var sPt = crv.PointAtStart;
    var ePt = crv.PointAtEnd;
    var pt = dorCrv.PointAt(0.5);
    var dis1 = sPt.DistanceTo(pt);
    var dis2 = ePt.DistanceTo(pt);
    if(dis1 < dis2)
    {
      A = true;
    }else
    {
      A = false;
    }
# ---------- end c_script ----------
flip = FlipCurve(Curve=crv)  # -> Curve, Flag
filter = StreamFilter(Gate=c_script.A, Stream0=crv, Stream1=flip.Curve)
vec = Vector(filter)
s_0 = ClusterOutput(filter)
vec_2 = ClusterOutput(vec)

# ==== cluster 矫正曲线方向指向门线_2
crv = ClusterInput()
dorcrv = ClusterInput()
c_script = CSharpScript(crv=crv, dorCrv=dorcrv)  # -> out, A; inputs crv: Curve, dorCrv: Curve; same code as c_script
flip = FlipCurve(Curve=crv)  # -> Curve, Flag
filter = StreamFilter(Gate=c_script.A, Stream0=crv, Stream1=flip.Curve)
vec = Vector(filter)
s_1 = ClusterOutput(filter)
vec_2 = ClusterOutput(vec)

# ==== cluster 判断是否有凹槽且凹槽是否与门同侧
relay = ClusterInput()
crv = Curve(relay)
门线 = ClusterInput()
explode = Explode(Curve=crv, Recursive=True)  # -> Segments, Vertices
门线_2 = Curve(门线)
item = ListItem(List=explode.Segments, Index=0, Wrap=True)
vec = Vector(门线_2)
vec_2 = Vector(item)
c_script = CSharpScript(groove=relay)  # -> out, A; inputs groove: Curve
# ---------- c_script: C# ----------
    bool result = false;
    
    if(groove != null)
    {
      result = true;
    }
    
    A = result;
# ---------- end c_script ----------
multiplication = Multiplication(A=vec_2, B=vec)
equals = Equality(FirstNumber=multiplication, SecondNumber="0")  # -> Equality, Inequality
and = GateAnd(A=c_script.A, B=equals.Equality)
R = ClusterOutput(and)

# ==== cluster 摆放家具0416: 常用于摆放软装/靠墙家具
向量输出 = 向量输出()

panel = Panel("定位点所需要的线(所在/所背靠)")
背靠线方向 = ClusterInput()

panel_2 = Panel("面向区域的中心")
向心 = ClusterInput()

panel_3 = Panel("z方向上下移动可以留空")
z方向位移 = ClusterInput()

区域边界 = ClusterInput()
背靠线方向_2 = Geometry(背靠线方向)

panel_4 = Panel("物件要摆放到的位置")
定位点 = ClusterInput()

区域边界_2 = Geometry(区域边界)
向心_2 = Point(graft(向心))
背靠线方向_3 = Vector(背靠线方向_2)
定位点_2 = Point(定位点)
vec2pt = Vector2Pt(PointA=定位点_2, PointB=向心_2, Unitize=False)  # -> Vector, Length
unit = UnitVector(Vector=背靠线方向_3)

# ---- group: 指向外部bug
number_slider = Slider(0.1, range=0..0.1)
panel_5 = Panel("""不涉及房间中心偏离到线外侧的情况 
普通家具排列时区域边界可以留空""")

# ----
vdis = VectorDisplay(Anchor=定位点_2, Vector=背靠线方向_3)
_0 = _0()
panel_6 = Panel(定位点_2)
目标点 = Point(定位点_2)
线向量 = Geometry(背靠线方向_3)
面向线 = ClusterInput()
面向线_2 = Data(面向线)

panel_7 = Panel("这个选项卡拉出去选择放物品要用的参考点")
参考点 = ClusterInput()
list = ValueList({"沿墙底边中点": 0, "物件底面中心": 1, "沿墙上边中点": 2, "物件上面中心": 3}, selected="沿墙底边中点")

家具 = ClusterInput()
panel_8 = Panel("""默认背靠线

选择面向线后
向心向量变为背心向量""")
rev = Reverse(Vector=线向量)
家具_2 = Geometry(家具)

# ---- group: 得到物体平面
cluster = Cluster_7(geo=家具_2, 参考点=参考点)

# ----
equals = Equality(FirstNumber=参考点, SecondNumber="1")  # -> Equality, Inequality
equals_2 = Equality(FirstNumber=参考点, SecondNumber="3")  # -> Equality, Inequality
or = GateOr(A=equals.Equality, B=equals_2.Equality)

# ---- group: 如果中心排
crv_cp = CurveClosestPoint(Point=定位点_2, Curve=背靠线方向_2)  # -> Point, Parameter, Distance
vec2pt_2 = Vector2Pt(PointA=crv_cp.Point, PointB=向心_2, Unitize=False)  # -> Vector, Length
filter = StreamFilter(Gate=or, Stream0=vec2pt.Vector, Stream1=vec2pt_2.Vector)

# ----
vec = Vector(filter)
angle = Angle(VectorA=背靠线方向_3, VectorB=vec)  # -> Angle, Reflex
vlen = VectorLength(Vector=vec)
cos = Cosine(Value=angle.Angle)
multiplication = Multiplication(A=cos, B=vlen)
multiplication_2 = Multiplication(A=multiplication, B=unit)
subtraction = Subtraction(A=vec, B=multiplication_2)
unit_2 = UnitVector(Vector=subtraction)
向心向量 = Vector(unit_2)

# ---- group: 指向外部bug
amp = Amplitude(Vector=向心向量, Amplitude=number_slider)
move = Move(Geometry=定位点_2, Motion=amp)  # -> Geometry, Transform
incurve = PointInCurve(Point=move.Geometry, Curve=区域边界_2)  # -> Relationship, Point
equals_3 = Equality(FirstNumber=incurve.Relationship, SecondNumber=2)  # -> Equality, Inequality
dispatch = Dispatch(List=向心向量, DispatchPattern=equals_3.Equality)  # -> ListA, ListB
rev_2 = Reverse(Vector=dispatch.ListB)
weave = Weave(Pattern=equals_3.Equality, Stream0=rev_2, Stream1=dispatch.ListA, NullGaps=False)
panel_9 = Panel(weave)

# ----
vdis_2 = VectorDisplay(Anchor=定位点_2, Vector=向心向量)
null = NullItem(Item=weave)  # -> NullFlags, InvalidFlags, Description
filter_2 = StreamFilter(Gate=null.NullFlags, Stream0=weave, Stream1=向心向量)
rev_3 = Reverse(Vector=filter_2)
stream_filter = CSharpScript(gate=面向线_2, u=filter_2, x=rev_3)  # -> out, A; inputs gate: Int32, u: list, x: list, y: list, z: list
# ---------- stream_filter: C# ----------
    // 将 gate 转换为 int
    int gateValue = Convert.ToInt32(gate);

    // 根据 gate 的值选择对应的列表
    List<object> selectedList = null;
    switch (gateValue)
    {
      case 0:
        selectedList = u;
        break;
      case 1:
        selectedList = x;
        break;
      case 2:
        selectedList = y;
        break;
      case 3:
        selectedList = z;
        break;
      default:
        // 如果 gate 的值不在 0 到 3 之间，抛出异常或进行其他处理
        throw new ArgumentOutOfRangeException("gate", "gate 的值必须在 0 到 3 之间");
    }

    // 创建 GH_GeometryGroup 实例
    List<object> c = new List<object>();

    // 遍历 selectedList 中的每个对象
    foreach (var item in selectedList)
    {
      // 检测对象是否为 List<object> 类型
      var nestedList = item as List<object>;
      if (nestedList != null)
      {
        // 将 nestedList 中的对象逐个转换为几何对象并添加到新的 GH_GeometryGroup
        GH_GeometryGroup nestedGrp = new GH_GeometryGroup();
        foreach (var nestedItem in nestedList)
        {
          var goo = GH_Convert.ToGeometricGoo(nestedItem);
          nestedGrp.Objects.Add(goo);
        }
        // 将新的 GH_GeometryGroup 添加到主组中
        c.Add(nestedGrp);
      }
      else
      {
        // 将非 List<object> 类型的对象直接转换为几何对象并添加到主组中
        c.Add(item);

      }
    }

    // 将 GH_GeometryGroup 赋值给 A
    A = c;
# ---------- end stream_filter ----------
向心向量_2 = Geometry(stream_filter.A)
rev_4 = Reverse(Vector=向心向量_2)
pl = ConstructPlane(Origin=目标点, XAxis=线向量, YAxis=rev_4)
deplane = DeconstructPlane(Plane=pl)  # -> Origin, XAxis, YAxis, ZAxis
devec = DeconstructVector(Vector=deplane.ZAxis)  # -> XComponent, YComponent, ZComponent
pl_2 = ConstructPlane(Origin=目标点, XAxis=rev, YAxis=rev_4)
smaller = SmallerThan(FirstNumber=devec.ZComponent, SecondNumber=0)  # -> SmallerThan, OrEqualTo

# ---- group: 得到物体平面 / 物体平面
pln = Plane(cluster)

# ----
multi_stream = MultiStream(z=smaller.SmallerThan, a=pl, b=pl_2)
trim到指定深度 = Trim到指定深度(tree=pln)
null_2 = NullPlaceholder()
orient = Orient(Geometry=pln, Source=pln, Target=multi_stream)  # -> Geometry, Transform
orient_2 = Orient(Geometry=家具_2, Source=trim到指定深度, Target=multi_stream)  # -> Geometry, Transform
null_3 = NullItem(Item=orient_2.Transform)  # -> NullFlags, InvalidFlags, Description

# ---- group: 纵向微调
Z = UnitZ(Factor=z方向位移)
move_2 = Move(Geometry=orient_2.Geometry, Motion=Z)  # -> Geometry, Transform

# ----
suirify = Suirify(null_3.NullFlags)
move_3 = Move(Geometry=orient.Geometry, Motion=Z)  # -> Geometry, Transform
G = ClusterOutput(move_3.Geometry)
A = ClusterOutput(stream_filter.A)
matrix = DisplayMatrix(orient_2.Transform)
geo = Geometry(move_2.Geometry)
矩阵计算 = 矩阵计算(M=orient_2.Transform)  # -> data_2, 旋转矩阵
suirify_2 = Suirify(矩阵计算.data_2)
_0_2 = _0(data=suirify, L=null_2, L_2=suirify_2)
三轴旋转角 = Data(_0_2)
三轴旋转角_2 = ClusterOutput(三轴旋转角)
旋转矩阵 = ClusterOutput(矩阵计算.旋转矩阵)
panel_10 = Panel(_0_2)
panel_11 = Panel(三轴旋转角)
geo_2 = ClusterOutput(geo)

# ==== cluster 向内偏移曲线
C = ClusterInput()
D = ClusterInput()
offset = OffsetCurve(Curve=C, Distance=expr("-X", D), Corners=1)
offset_2 = OffsetCurve(Curve=C, Distance=D, Corners=1)
len = Length(Curve=offset)
len_2 = Length(Curve=offset_2)
smaller = SmallerThan(FirstNumber=len, SecondNumber=len_2)  # -> SmallerThan, OrEqualTo
filter = StreamFilter(Gate=smaller.SmallerThan, Stream0=offset_2, Stream1=offset)
stream = ClusterOutput(filter)

# ==== cluster 向内偏移曲线_2
C = ClusterInput()
D = ClusterInput()
offset = OffsetCurve(Curve=C, Distance=expr("-X", D), Corners=1)
offset_2 = OffsetCurve(Curve=C, Distance=D, Corners=1)
len = Length(Curve=offset)
len_2 = Length(Curve=offset_2)
smaller = SmallerThan(FirstNumber=len, SecondNumber=len_2)  # -> SmallerThan, OrEqualTo
filter = StreamFilter(Gate=smaller.SmallerThan, Stream0=offset_2, Stream1=offset)
s_1 = ClusterOutput(filter)

# ==== cluster 指向内部向量
C = ClusterInput()
C_2 = ClusterInput()
end = EndPoints(Curve=C)  # -> Start, End
explode = Explode(Curve=C_2, Recursive=True)  # -> Segments, Vertices
pi = Pi(Factor=1)
vec = Vector(C)
avr = Average(Input=flatten(explode.Vertices))
Z = UnitZ(Factor=1)
multiplication = Multiplication(A=pi, B=0.5)
ln = Line(StartPoint=end.Start, EndPoint=avr)
vrot = Rotate(Vector=vec, Axis=Z, Angle=multiplication)
vec_2 = Vector(ln)
angle = Angle(VectorA=vec_2, VectorB=vrot)  # -> Angle, Reflex
rev = Reverse(Vector=vrot)
larger = LargerThan(FirstNumber=angle.Angle, SecondNumber=multiplication)  # -> LargerThan, OrEqualTo
filter = StreamFilter(Gate=larger.LargerThan, Stream0=vrot, Stream1=rev)
s_1 = ClusterOutput(filter)

# ==== cluster 指向内部向量_2
C = ClusterInput()
C_2 = ClusterInput()
end = EndPoints(Curve=C)  # -> Start, End
explode = Explode(Curve=C_2, Recursive=True)  # -> Segments, Vertices
pi = Pi(Factor=1)
vec = Vector(C)
avr = Average(Input=flatten(explode.Vertices))
Z = UnitZ(Factor=1)
multiplication = Multiplication(A=pi, B=0.5)
ln = Line(StartPoint=end.Start, EndPoint=avr)
vrot = Rotate(Vector=vec, Axis=Z, Angle=multiplication)
vec_2 = Vector(ln)
angle = Angle(VectorA=vec_2, VectorB=vrot)  # -> Angle, Reflex
rev = Reverse(Vector=vrot)
larger = LargerThan(FirstNumber=angle.Angle, SecondNumber=multiplication)  # -> LargerThan, OrEqualTo
filter = StreamFilter(Gate=larger.LargerThan, Stream0=vrot, Stream1=rev)
s_0 = ClusterOutput(filter)

# ==== cluster Cluster_7
geo = ClusterInput()
geo_2 = Geometry(geo)
bbox = BoundingBox(Content=geo_2, Plane=PlaneXY(0, 0, 0))  # -> Box, Box_2
debrep = DeconstructBrep(Brep=bbox.Box)  # -> Faces, Edges, Vertices
item = ListItem(List=debrep.Edges, Index=Slider(6, range=0..10), Wrap=True)
item_2 = ListItem(List=debrep.Edges, Index=Slider(2, range=0..10), Wrap=True)
item_3 = ListItem(List=debrep.Faces, Index=Slider(5, range=0..10), Wrap=True)
item_4 = ListItem(List=debrep.Faces, Index=Slider(4, range=0..10), Wrap=True)
沿墙底边中点 = CurveMiddle(Curve=item_2)
参考点 = ClusterInput()
沿墙上边中点 = CurveMiddle(Curve=item)
物件底面中心 = Area(Geometry=item_3)  # -> Area, Centroid
物件底面中心_2 = Area(Geometry=item_4)  # -> Area, Centroid
filter = StreamFilter(Gate=参考点, Stream0=沿墙底边中点, Stream1=物件底面中心_2.Centroid, Stream2=沿墙上边中点, Stream3=物件底面中心.Centroid)
xy = XYPlane(Origin=filter)

# ---- group: 物体平面
pln = Plane(simplify(xy))

# ----
pln_2 = ClusterOutput(pln)
panel = Panel(pln)

# ==== cluster MultiStream
z = ClusterInput()
a = ClusterInput()
b = ClusterInput()
multi_stream = GhPythonScript(z=z, a=a, b=b)  # -> out, o; inputs z: list, a: list, b: list
# ---------- multi_stream: Python ----------
o = []
print len(z)

for i in range(len(z)):
    if z[i] == False:
        o.append(a[i])
    else:
        o.append(b[i])
# ---------- end multi_stream ----------
o = ClusterOutput(multi_stream.o)

# ==== cluster Trim到指定深度
tree = ClusterInput()
tree_statistics = TreeStatistics(Tree=tree)  # -> Paths, Length, Count
deconstruct_path = DeconstructPath(Branch=tree_statistics.Paths)
list_length = ListLength(List=deconstruct_path)
subtraction = Subtraction(A=list_length, B=Slider(1, range=0..1))
trim_tree = TrimTree(Tree=tree, Depth=subtraction)
tree_2 = ClusterOutput(trim_tree)

# ==== cluster 矩阵计算
M = ClusterInput()

# ----
# wip
number_slider = Slider(9, range=0..10)
dematrix = DeconstructMatrix(Matrix=M)  # -> Rows, Columns, Values
cull = CullPattern(List=dematrix.Values, CullPattern=[True, True, True, False])
split = SplitList(List=cull, Index=number_slider)  # -> ListA, ListB

# ---- group: 旋转矩阵计算
matrix = ConstructMatrix(Rows="3", Columns="3", Values=split.ListA)
matrix_2 = DisplayMatrix(matrix)
dematrix_2 = DeconstructMatrix(Matrix=matrix)  # -> Rows, Columns, Values
item = ListItem(List=dematrix_2.Values, Index=0, Wrap=True)  # -> Item, Item1, Item2, Item3, Item4, Item5, Item6, Item7, Item8
e01 = Data(item.Item1)
e11 = Data(item.Item4)
e20 = Data(item.Item6)
e21 = Data(item.Item7)
e22 = Data(item.Item8)
panel = Panel(e22)
panel_2 = Panel(e11)
panel_3 = Panel(e20)
panel_4 = Panel(e21)
panel_5 = Panel(e01)

# ----
python = GhPythonScript(e01=e01, e11=e11, e20=e20, e21=e21, e22=e22)  # -> out, x, y, z
# ---------- python: Python ----------
import math

x = math.degrees(math.asin(e21))  #p

y = math.degrees(math.atan2(-e20,e22))  #h

z = math.degrees(math.atan2(-e01,e11))  #r
# ---------- end python ----------
pt = ConstructPoint(XCoordinate=python.x, YCoordinate=python.y, ZCoordinate=python.z)
旋转矩阵 = ClusterOutput(matrix)
data = Data(pt)
data_2 = ClusterOutput(data)

# ==== cluster 向量输出
C = ClusterInput()
B = ClusterInput()
eval = EvaluateCurve(Curve=C, Parameter="0.5")  # -> Point, Tangent, Angle
rotate = Rotate(Geometry=eval.Tangent, Angle=1.570796327, Plane=PlaneXY(0, 0, 0))  # -> Geometry, Transform
ln = Line(StartPoint=eval.Point, EndPoint=B)
vec = Vector(ln)
neg = Negative(Value=rotate.Geometry)
devec = DeconstructVector(Vector=vec)  # -> XComponent, YComponent, ZComponent
merge = Merge(Data1=rotate.Geometry, Data2=neg)
devec_2 = DeconstructVector(Vector=merge)  # -> XComponent, YComponent, ZComponent
equals = Equality(FirstNumber=devec_2.XComponent, SecondNumber="0")  # -> Equality, Inequality
_0 = Cluster(G=equals.Equality, _0=devec.YComponent, _1=devec.XComponent)
smaller = SmallerThan(FirstNumber=_0, SecondNumber="0")  # -> SmallerThan, OrEqualTo
_0_2 = Cluster(G=equals.Equality, _0=devec_2.YComponent, _1=devec_2.XComponent)
smaller_2 = SmallerThan(FirstNumber=_0_2, SecondNumber="0")  # -> SmallerThan, OrEqualTo
cull = CullPattern(List=merge, CullPattern=smaller_2.SmallerThan)
cull_2 = CullPattern(List=merge, CullPattern=invert(smaller_2.SmallerThan))
_0_3 = Cluster(G=smaller.SmallerThan, _0=cull, _1=cull_2)
vec_2 = Vector(_0_3)
输出向量 = ClusterOutput(vec_2)
panel = Panel(cull)

# ==== cluster _0
data = ClusterInput()
L = ClusterInput()
L_2 = ClusterInput()
data_2 = Data(data)
cull = CullPattern(List=L_2, CullPattern=invert(data_2))
cull_2 = CullPattern(List=L, CullPattern=data_2)
L_3 = ClusterOutput([cull_2, cull])
