# Grasshopper definition 数据读取.gh (Grasshopper 1.0.7)

num2 = GetNumber(Slider(6, range=0..10), AtLeast=1, AtMost=1, Maximum=1.797693135e+308, Minimum=-1.797693135e+308, TreeAccess=False)
num1 = GetNumber(Slider(3, range=0..10), AtLeast=1, AtMost=1, Maximum=1.797693135e+308, Minimum=-1.797693135e+308, TreeAccess=False)
multiplication = Multiplication(A=num1, B=num2)
num = Number(multiplication)
panel = Panel(num)
context_print = ContextPrint(Result=num)
