# Grasshopper definition 数据输出.gh (Grasshopper 1.0.7)

飘窗线 = Curve([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])
最大矩形 = Curve(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)
# 经过处理后得到的线
门线 = Curve(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)
窗线 = Curve(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)

context_bake = ContextBake(Rectangle=最大矩形)
context_bake_2 = ContextBake(Geometry=窗线)
context_bake_3 = ContextBake(BayWindows=飘窗线)
context_bake_4 = ContextBake(Geometry=门线)
panel = Panel(飘窗线)
panel_2 = Panel(最大矩形)
panel_3 = Panel(窗线)
panel_4 = Panel(门线)
